# Grasshopper definition GenerateCase.gh (Grasshopper 1.0.7)
# plug-ins: Pufferfish

output_directory = Panel("C:\Users\tgerrish\Desktop\_0Ghadan21")
weatherfile = Panel("C:\Users\tgerrish\Documents\GitHub\oshe\projects\UWG_ARE_AZ_Abu.Dhabi-Bateen.Exec.AP.412160_TMYx_URBAN_02.epw")
material = Panel("""BDG_CONTEXT
MediumRough
0.2032
1.95
2240
900
0.9
0.7
0""")
material_2 = Panel("""GND_SURROUNDING
MediumRough
0.2
1.73
2243
837
0.9
0.65
0""")
ladybug = Ladybug_Ladybug()  # -> Vviiiiiiiiiizzz; plug-in component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
honeybee = Honeybee_Honeybee()  # -> Vviiiiiiiiiizzz; plug-in component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
material_3 = Panel("""GND_CONCRETEDARK
MediumRough
0.2
1.73
2243
837
0.9
0.7
0""")
material_4 = Panel("""GND_CONCRETELIGHT
MediumRough
0.2
1.73
2243
837
0.9
0.65
0""")
material_5 = Panel("""GND_VEGETATION
Rough
0.2
1
1250
1252
0.92
0.75
0""")
material_6 = Panel("""GND_SAND
Rough
0.2
1.25
2100
810
0.88
0.7
0""")
material_7 = Panel("""GND_WOOD
MediumSmooth
0.1
0.167
680
1630
0.9
0.7
0""")
material_8 = Panel("""GND_STONEDARK
MediumRough
0.2
2
2243
790
0.9
0.7
0""")
material_9 = Panel("""GND_GRASS
Rough
0.2
1
1250
1252
0.92
0.75
0""")
material_10 = Panel("""GND_WATER
MediumRough
0.2
1.4
1840
1480
0.95
0.8
0""")
material_11 = Panel("""GND_STONE
MediumRough
0.2
2
2243
790
0.9
0.55
0""")
e_executable_path = Panel("C:\openstudio-2.9.0\EnergyPlus\energyplus.exe")
material_12 = Panel("""GND_ASPHALT
MediumRough
0.2
0.75
2360
920
0.93
0.87
0""")
material_13 = Panel("""VEG_GHAF
VeryRough
0.05
0.01
0.5
150
0.9
0.7
0.15""")
material_14 = Panel("""SHD_SOLID
MediumRough
0.102
0.12
320
795
0.9
0.7
0""")
material_15 = Panel("""SHD_FABRIC
MediumRough
0.102
0.12
320
795
0.9
0.7
0.15""")
top_layer_name = Panel("EXAMPLE")
refreshall = Button()
panel = Panel("""8
16""")
reload_geometry = Boolean(invert(refreshall))
bool = Boolean(reload_geometry)
outputdirectory = Text(output_directory)
weatherfile_2 = FilePath(weatherfile)
toplayer = Data(top_layer_name)
toplayer_2 = Data(toplayer)

# ---- group: CONTEXT BUILDING MASSES
python = GhPythonScript(Refresh=bool, MaterialPanel=material)  # -> LayerName, Roughness, Thickness, Conductivity, Density, SpecificHeat, ThermalAbsorptivity, SolarAbsorptivity, Porosity; inputs Refresh: Boolean, MaterialPanel: list
# ---------- python: Python ----------
if Refresh:
    pass

LayerName = str(MaterialPanel[0])
Roughness = str(MaterialPanel[1])
Thickness = float(MaterialPanel[2])
Conductivity = float(MaterialPanel[3])
Density = float(MaterialPanel[4])
SpecificHeat = float(MaterialPanel[5])
ThermalAbsorptivity = float(MaterialPanel[6])
SolarAbsorptivity = float(MaterialPanel[7])
Porosity = float(MaterialPanel[8])
# ---------- end python ----------
list = ValueList({"All objects": 0, "Point": 1, "Point cloud": 2, "Curve": 4, "Surface or single-face brep": 8, "Polysurface or multiple-face": 16, "Mesh": 32, "Light": 256, "Annotation": 512, "Instance or block reference": 4096, "Text dot object": 8192, "Grip object": 16384, "Detail": 32768, "Hatch": 65536, "Morph control": 131072, "Cage": 134217728, "Phantom": 268435456, "Clipping plane": 536870912, "Extrusion": 1073741824}, selected="Polysurface or multiple-face")
cluster = Cluster_4(case=toplayer_2, layer=python.LayerName, geometrytype=list, refresh=bool)
cluster_2 = Cluster_3(solarabsorptivity=python.SolarAbsorptivity)
epopaquemat = Honeybee_EnergyPlusOpaqueMaterial(
    name=python.LayerName,
    roughness=python.Roughness,
    thickness=python.Thickness,
    conductivity=python.Conductivity,
    density=python.Density,
    specificHeat=python.SpecificHeat,
    thermAbsp=python.ThermalAbsorptivity,
    solAbsp=python.SolarAbsorptivity,
    visAbsp=python.SolarAbsorptivity)  # -> EPMaterial; plug-in component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
namify = GhPythonScript(geometry=cluster, name=python.LayerName)  # -> names; inputs geometry: list; same code as namify
debrep = DeconstructBrep(Brep=cluster)  # -> flatten(Faces), Edges, Vertices
mass2zone = Honeybee_Masses2Zones(zoneMasses=flatten(cluster), zoneNames=namify, maxRoofAngle=30, createHBZones=Toggle(True))  # -> readMe, HBZones; plug-in component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
epconstruction = Honeybee_EnergyPlusConstruction(name=python.LayerName, layer_1=epopaquemat)  # -> EPConstruction; plug-in component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
radopaquemat = HoneybeePlus_RadianceOpaqueMaterial(name=graft(python.LayerName), reflect=graft(cluster_2), spec=0, rough=0)  # -> simplify(material); plug-in component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
lng = ListLength(List=debrep.Faces)
series = Series(Start=0, Step=1, Count=lng)
concat = Concatenate(FragmentA=python.LayerName, FragmentB=series)
setepzonecnstr = Honeybee_SetEPZoneConstruction(
    HBZones=flatten(mass2zone.HBZones),
    wallEPConstruction=epconstruction,
    roofEPConstruction=epconstruction,
    floorEPConstruction=epconstruction,
    expFloorEPConstruction=epconstruction)  # -> simplify(modifiedHBZones); plug-in component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
hbsurface = HoneybeePlus_HoneybeeSurface(geo=debrep.Faces, names=concat, type="0", rad_mat=radopaquemat)  # -> report, flatten(HB_srf); plug-in component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
hbzones_energyplus = Data(flatten(setepzonecnstr))
hb_srfs_radiance = Data(flatten(hbsurface.HB_srf))

# ---- group: GROUND SURFACES
python_2 = GhPythonScript(Refresh=bool, MaterialPanel=material_2)  # -> LayerName, Roughness, Thickness, Conductivity, Density, SpecificHeat, ThermalAbsorptivity, SolarAbsorptivity, Porosity; inputs Refresh: Boolean, MaterialPanel: list; same code as python
epopaquemat_2 = Honeybee_EnergyPlusOpaqueMaterial(
    name=python_2.LayerName,
    roughness=python_2.Roughness,
    thickness=python_2.Thickness,
    conductivity=python_2.Conductivity,
    density=python_2.Density,
    specificHeat=python_2.SpecificHeat,
    thermAbsp=python_2.ThermalAbsorptivity,
    solAbsp=python_2.SolarAbsorptivity,
    visAbsp=python_2.SolarAbsorptivity)  # -> EPMaterial; plug-in component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
cluster_3 = Cluster(toplayer=toplayer_2, layername=python_2.LayerName)  # -> surfaces_2, surfacenames_2
radopaquemat_2 = HoneybeePlus_RadianceOpaqueMaterial(name=graft(python_2.LayerName), reflect=graft(0.35), spec=0, rough=0)  # -> simplify(material); plug-in component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
epconstruction_2 = Honeybee_EnergyPlusConstruction(name=python_2.LayerName, layer_1=epopaquemat_2)  # -> EPConstruction; plug-in component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
createhbsrfs = Honeybee_createHBSrfs(geometry=cluster_3.surfaces_2, srfName=cluster_3.surfacenames_2, srfType="2", EPConstruction=epconstruction_2)  # -> readMe, simplify(flatten(HBSurface)); plug-in component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
hbsurface_2 = HoneybeePlus_HoneybeeSurface(geo=cluster_3.surfaces_2, names=cluster_3.surfacenames_2, type="2", rad_mat=radopaquemat_2)  # -> report, flatten(HB_srf); plug-in component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
hbsrfs_energyplus = Data(flatten(createhbsrfs.HBSurface))
hb_srfs_radiance_2 = Data(flatten(hbsurface_2.HB_srf))

python_3 = GhPythonScript(Refresh=bool, MaterialPanel=material_6)  # -> LayerName, Roughness, Thickness, Conductivity, Density, SpecificHeat, ThermalAbsorptivity, SolarAbsorptivity, Porosity; inputs Refresh: Boolean, MaterialPanel: list; same code as python
cluster_4 = Cluster(toplayer=toplayer_2, layername=python_3.LayerName)  # -> surfaces_2, surfacenames_2
cluster_5 = Cluster_3(solarabsorptivity=python_3.SolarAbsorptivity)
epopaquemat_3 = Honeybee_EnergyPlusOpaqueMaterial(
    name=python_3.LayerName,
    roughness=python_3.Roughness,
    thickness=python_3.Thickness,
    conductivity=python_3.Conductivity,
    density=python_3.Density,
    specificHeat=python_3.SpecificHeat,
    thermAbsp=python_3.ThermalAbsorptivity,
    solAbsp=python_3.SolarAbsorptivity,
    visAbsp=python_3.SolarAbsorptivity)  # -> EPMaterial; plug-in component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
epconstruction_3 = Honeybee_EnergyPlusConstruction(name=python_3.LayerName, layer_1=epopaquemat_3)  # -> EPConstruction; plug-in component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
radopaquemat_3 = HoneybeePlus_RadianceOpaqueMaterial(name=graft(python_3.LayerName), reflect=graft(cluster_5), spec=0, rough=0)  # -> simplify(material); plug-in component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
cluster_6 = Cluster_2(surfaces=cluster_4.surfaces_2)
createhbsrfs_2 = Honeybee_createHBSrfs(geometry=cluster_4.surfaces_2, srfName=cluster_4.surfacenames_2, srfType="1", EPConstruction=epconstruction_3)  # -> readMe, simplify(flatten(HBSurface)); plug-in component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
hbsurface_3 = HoneybeePlus_HoneybeeSurface(geo=cluster_4.surfaces_2, names=cluster_4.surfacenames_2, type="1", rad_mat=radopaquemat_3)  # -> report, flatten(HB_srf); plug-in component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
hbsrfs_energyplus_2 = Data(flatten(createhbsrfs_2.HBSurface))
hb_srfs_radiance_3 = Data(flatten(hbsurface_3.HB_srf))
boundaries = Data(flatten(cluster_6))
reflectivity = Data(flatten(cluster_5))

python_4 = GhPythonScript(Refresh=bool, MaterialPanel=material_7)  # -> LayerName, Roughness, Thickness, Conductivity, Density, SpecificHeat, ThermalAbsorptivity, SolarAbsorptivity, Porosity; inputs Refresh: Boolean, MaterialPanel: list; same code as python
cluster_7 = Cluster_3(solarabsorptivity=python_4.SolarAbsorptivity)
cluster_8 = Cluster(toplayer=toplayer_2, layername=python_4.LayerName)  # -> surfaces_2, surfacenames_2
epopaquemat_4 = Honeybee_EnergyPlusOpaqueMaterial(
    name=python_4.LayerName,
    roughness=python_4.Roughness,
    thickness=python_4.Thickness,
    conductivity=python_4.Conductivity,
    density=python_4.Density,
    specificHeat=python_4.SpecificHeat,
    thermAbsp=python_4.ThermalAbsorptivity,
    solAbsp=python_4.SolarAbsorptivity,
    visAbsp=python_4.SolarAbsorptivity)  # -> EPMaterial; plug-in component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
radopaquemat_4 = HoneybeePlus_RadianceOpaqueMaterial(name=graft(python_4.LayerName), reflect=graft(cluster_7), spec=0, rough=0)  # -> simplify(material); plug-in component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
epconstruction_4 = Honeybee_EnergyPlusConstruction(name=python_4.LayerName, layer_1=epopaquemat_4)  # -> EPConstruction; plug-in component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
cluster_9 = Cluster_2(surfaces=cluster_8.surfaces_2)
createhbsrfs_3 = Honeybee_createHBSrfs(geometry=cluster_8.surfaces_2, srfName=cluster_8.surfacenames_2, srfType="1", EPConstruction=epconstruction_4)  # -> readMe, simplify(flatten(HBSurface)); plug-in component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
hbsurface_4 = HoneybeePlus_HoneybeeSurface(geo=cluster_8.surfaces_2, names=cluster_8.surfacenames_2, type="1", rad_mat=radopaquemat_4)  # -> report, flatten(HB_srf); plug-in component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
hbsrfs_energyplus_3 = Data(flatten(createhbsrfs_3.HBSurface))
hb_srfs_radiance_4 = Data(flatten(hbsurface_4.HB_srf))
boundaries_2 = Data(flatten(cluster_9))
reflectivity_2 = Data(flatten(cluster_7))

python_5 = GhPythonScript(Refresh=bool, MaterialPanel=material_8)  # -> LayerName, Roughness, Thickness, Conductivity, Density, SpecificHeat, ThermalAbsorptivity, SolarAbsorptivity, Porosity; inputs Refresh: Boolean, MaterialPanel: list; same code as python
cluster_10 = Cluster_3(solarabsorptivity=python_5.SolarAbsorptivity)
cluster_11 = Cluster(toplayer=toplayer_2, layername=python_5.LayerName)  # -> surfaces_2, surfacenames_2
epopaquemat_5 = Honeybee_EnergyPlusOpaqueMaterial(
    name=python_5.LayerName,
    roughness=python_5.Roughness,
    thickness=python_5.Thickness,
    conductivity=python_5.Conductivity,
    density=python_5.Density,
    specificHeat=python_5.SpecificHeat,
    thermAbsp=python_5.ThermalAbsorptivity,
    solAbsp=python_5.SolarAbsorptivity,
    visAbsp=python_5.SolarAbsorptivity)  # -> EPMaterial; plug-in component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
radopaquemat_5 = HoneybeePlus_RadianceOpaqueMaterial(name=graft(python_5.LayerName), reflect=graft(cluster_10), spec=0, rough=0)  # -> simplify(material); plug-in component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
epconstruction_5 = Honeybee_EnergyPlusConstruction(name=python_5.LayerName, layer_1=epopaquemat_5)  # -> EPConstruction; plug-in component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
cluster_12 = Cluster_2(surfaces=cluster_11.surfaces_2)
createhbsrfs_4 = Honeybee_createHBSrfs(geometry=cluster_11.surfaces_2, srfName=cluster_11.surfacenames_2, srfType="1", EPConstruction=epconstruction_5)  # -> readMe, simplify(flatten(HBSurface)); plug-in component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
hbsurface_5 = HoneybeePlus_HoneybeeSurface(geo=cluster_11.surfaces_2, names=cluster_11.surfacenames_2, type="1", rad_mat=radopaquemat_5)  # -> report, flatten(HB_srf); plug-in component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
hbsrfs_energyplus_4 = Data(flatten(createhbsrfs_4.HBSurface))
hb_srfs_radiance_5 = Data(flatten(hbsurface_5.HB_srf))
boundaries_3 = Data(flatten(cluster_12))
reflectivity_3 = Data(flatten(cluster_10))

python_6 = GhPythonScript(Refresh=bool, MaterialPanel=material_3)  # -> LayerName, Roughness, Thickness, Conductivity, Density, SpecificHeat, ThermalAbsorptivity, SolarAbsorptivity, Porosity; inputs Refresh: Boolean, MaterialPanel: list; same code as python
cluster_13 = Cluster_3(solarabsorptivity=python_6.SolarAbsorptivity)
cluster_14 = Cluster(toplayer=toplayer_2, layername=python_6.LayerName)  # -> surfaces_2, surfacenames_2
epopaquemat_6 = Honeybee_EnergyPlusOpaqueMaterial(
    name=python_6.LayerName,
    roughness=python_6.Roughness,
    thickness=python_6.Thickness,
    conductivity=python_6.Conductivity,
    density=python_6.Density,
    specificHeat=python_6.SpecificHeat,
    thermAbsp=python_6.ThermalAbsorptivity,
    solAbsp=python_6.SolarAbsorptivity,
    visAbsp=python_6.SolarAbsorptivity)  # -> EPMaterial; plug-in component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
radopaquemat_6 = HoneybeePlus_RadianceOpaqueMaterial(name=graft(python_6.LayerName), reflect=graft(cluster_13), spec=0, rough=0)  # -> simplify(material); plug-in component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
epconstruction_6 = Honeybee_EnergyPlusConstruction(name=python_6.LayerName, layer_1=epopaquemat_6)  # -> EPConstruction; plug-in component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
cluster_15 = Cluster_2(surfaces=cluster_14.surfaces_2)
createhbsrfs_5 = Honeybee_createHBSrfs(geometry=cluster_14.surfaces_2, srfName=cluster_14.surfacenames_2, srfType="1", EPConstruction=epconstruction_6)  # -> readMe, simplify(flatten(HBSurface)); plug-in component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
hbsurface_6 = HoneybeePlus_HoneybeeSurface(geo=cluster_14.surfaces_2, names=cluster_14.surfacenames_2, type="1", rad_mat=radopaquemat_6)  # -> report, flatten(HB_srf); plug-in component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
hbsrfs_energyplus_5 = Data(flatten(createhbsrfs_5.HBSurface))
hb_srfs_radiance_6 = Data(flatten(hbsurface_6.HB_srf))
boundaries_4 = Data(flatten(cluster_15))
reflectivity_4 = Data(flatten(cluster_13))

python_7 = GhPythonScript(Refresh=bool, MaterialPanel=material_4)  # -> LayerName, Roughness, Thickness, Conductivity, Density, SpecificHeat, ThermalAbsorptivity, SolarAbsorptivity, Porosity; inputs Refresh: Boolean, MaterialPanel: list; same code as python
cluster_16 = Cluster_3(solarabsorptivity=python_7.SolarAbsorptivity)
cluster_17 = Cluster(toplayer=toplayer_2, layername=python_7.LayerName)  # -> surfaces_2, surfacenames_2
epopaquemat_7 = Honeybee_EnergyPlusOpaqueMaterial(
    name=python_7.LayerName,
    roughness=python_7.Roughness,
    thickness=python_7.Thickness,
    conductivity=python_7.Conductivity,
    density=python_7.Density,
    specificHeat=python_7.SpecificHeat,
    thermAbsp=python_7.ThermalAbsorptivity,
    solAbsp=python_7.SolarAbsorptivity,
    visAbsp=python_7.SolarAbsorptivity)  # -> EPMaterial; plug-in component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
epconstruction_7 = Honeybee_EnergyPlusConstruction(name=python_7.LayerName, layer_1=epopaquemat_7)  # -> EPConstruction; plug-in component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
radopaquemat_7 = HoneybeePlus_RadianceOpaqueMaterial(name=graft(python_7.LayerName), reflect=graft(cluster_16), spec=0, rough=0)  # -> simplify(material); plug-in component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
cluster_18 = Cluster_2(surfaces=cluster_17.surfaces_2)
createhbsrfs_6 = Honeybee_createHBSrfs(geometry=cluster_17.surfaces_2, srfName=cluster_17.surfacenames_2, srfType="1", EPConstruction=epconstruction_7)  # -> readMe, simplify(flatten(HBSurface)); plug-in component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
hbsurface_7 = HoneybeePlus_HoneybeeSurface(geo=cluster_17.surfaces_2, names=cluster_17.surfacenames_2, type="1", rad_mat=radopaquemat_7)  # -> report, flatten(HB_srf); plug-in component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
hbsrfs_energyplus_6 = Data(flatten(createhbsrfs_6.HBSurface))
hb_srfs_radiance_7 = Data(flatten(hbsurface_7.HB_srf))
boundaries_5 = Data(flatten(cluster_18))
reflectivity_5 = Data(flatten(cluster_16))

python_8 = GhPythonScript(Refresh=bool, MaterialPanel=material_12)  # -> LayerName, Roughness, Thickness, Conductivity, Density, SpecificHeat, ThermalAbsorptivity, SolarAbsorptivity, Porosity; inputs Refresh: Boolean, MaterialPanel: list; same code as python
cluster_19 = Cluster_3(solarabsorptivity=python_8.SolarAbsorptivity)
cluster_20 = Cluster(toplayer=toplayer_2, layername=python_8.LayerName)  # -> surfaces_2, surfacenames_2
epopaquemat_8 = Honeybee_EnergyPlusOpaqueMaterial(
    name=python_8.LayerName,
    roughness=python_8.Roughness,
    thickness=python_8.Thickness,
    conductivity=python_8.Conductivity,
    density=python_8.Density,
    specificHeat=python_8.SpecificHeat,
    thermAbsp=python_8.ThermalAbsorptivity,
    solAbsp=python_8.SolarAbsorptivity,
    visAbsp=python_8.SolarAbsorptivity)  # -> EPMaterial; plug-in component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
radopaquemat_8 = HoneybeePlus_RadianceOpaqueMaterial(name=graft(python_8.LayerName), reflect=graft(cluster_19), spec=0, rough=0)  # -> simplify(material); plug-in component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
cluster_21 = Cluster_2(surfaces=cluster_20.surfaces_2)
epconstruction_8 = Honeybee_EnergyPlusConstruction(name=python_8.LayerName, layer_1=epopaquemat_8)  # -> EPConstruction; plug-in component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
createhbsrfs_7 = Honeybee_createHBSrfs(geometry=cluster_20.surfaces_2, srfName=cluster_20.surfacenames_2, srfType="1", EPConstruction=epconstruction_8)  # -> readMe, simplify(flatten(HBSurface)); plug-in component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
hbsurface_8 = HoneybeePlus_HoneybeeSurface(geo=cluster_20.surfaces_2, names=cluster_20.surfacenames_2, type="1", rad_mat=radopaquemat_8)  # -> report, flatten(HB_srf); plug-in component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
hbsrfs_energyplus_7 = Data(flatten(createhbsrfs_7.HBSurface))
hb_srfs_radiance_8 = Data(flatten(hbsurface_8.HB_srf))
boundaries_6 = Data(flatten(cluster_21))
reflectivity_6 = Data(flatten(cluster_19))

python_9 = GhPythonScript(Refresh=bool, MaterialPanel=material_10)  # -> LayerName, Roughness, Thickness, Conductivity, Density, SpecificHeat, ThermalAbsorptivity, SolarAbsorptivity, Porosity; inputs Refresh: Boolean, MaterialPanel: list; same code as python
cluster_22 = Cluster_3(solarabsorptivity=python_9.SolarAbsorptivity)
cluster_23 = Cluster(toplayer=toplayer_2, layername=python_9.LayerName)  # -> surfaces_2, surfacenames_2
epopaquemat_9 = Honeybee_EnergyPlusOpaqueMaterial(
    name=python_9.LayerName,
    roughness=python_9.Roughness,
    thickness=python_9.Thickness,
    conductivity=python_9.Conductivity,
    density=python_9.Density,
    specificHeat=python_9.SpecificHeat,
    thermAbsp=python_9.ThermalAbsorptivity,
    solAbsp=python_9.SolarAbsorptivity,
    visAbsp=python_9.SolarAbsorptivity)  # -> EPMaterial; plug-in component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
epconstruction_9 = Honeybee_EnergyPlusConstruction(name=python_9.LayerName, layer_1=epopaquemat_9)  # -> EPConstruction; plug-in component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
radopaquemat_9 = HoneybeePlus_RadianceOpaqueMaterial(name=graft(python_9.LayerName), reflect=graft(cluster_22), spec=0, rough=0)  # -> simplify(material); plug-in component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
cluster_24 = Cluster_2(surfaces=cluster_23.surfaces_2)
createhbsrfs_8 = Honeybee_createHBSrfs(geometry=cluster_23.surfaces_2, srfName=cluster_23.surfacenames_2, srfType="1", EPConstruction=epconstruction_9)  # -> readMe, simplify(flatten(HBSurface)); plug-in component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
hbsurface_9 = HoneybeePlus_HoneybeeSurface(geo=cluster_23.surfaces_2, names=cluster_23.surfacenames_2, type="1", rad_mat=radopaquemat_9)  # -> report, flatten(HB_srf); plug-in component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
hbsrfs_energyplus_8 = Data(flatten(createhbsrfs_8.HBSurface))
hb_srfs_radiance_9 = Data(flatten(hbsurface_9.HB_srf))
boundaries_7 = Data(flatten(cluster_24))
reflectivity_7 = Data(flatten(cluster_22))

python_10 = GhPythonScript(Refresh=bool, MaterialPanel=material_11)  # -> LayerName, Roughness, Thickness, Conductivity, Density, SpecificHeat, ThermalAbsorptivity, SolarAbsorptivity, Porosity; inputs Refresh: Boolean, MaterialPanel: list; same code as python
cluster_25 = Cluster_3(solarabsorptivity=python_10.SolarAbsorptivity)
cluster_26 = Cluster(toplayer=toplayer_2, layername=python_10.LayerName)  # -> surfaces_2, surfacenames_2
epopaquemat_10 = Honeybee_EnergyPlusOpaqueMaterial(
    name=python_10.LayerName,
    roughness=python_10.Roughness,
    thickness=python_10.Thickness,
    conductivity=python_10.Conductivity,
    density=python_10.Density,
    specificHeat=python_10.SpecificHeat,
    thermAbsp=python_10.ThermalAbsorptivity,
    solAbsp=python_10.SolarAbsorptivity,
    visAbsp=python_10.SolarAbsorptivity)  # -> EPMaterial; plug-in component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
radopaquemat_10 = HoneybeePlus_RadianceOpaqueMaterial(name=graft(python_10.LayerName), reflect=graft(cluster_25), spec=0, rough=0)  # -> simplify(material); plug-in component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
epconstruction_10 = Honeybee_EnergyPlusConstruction(name=python_10.LayerName, layer_1=epopaquemat_10)  # -> EPConstruction; plug-in component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
cluster_27 = Cluster_2(surfaces=cluster_26.surfaces_2)
createhbsrfs_9 = Honeybee_createHBSrfs(geometry=cluster_26.surfaces_2, srfName=cluster_26.surfacenames_2, srfType="1", EPConstruction=epconstruction_10)  # -> readMe, simplify(flatten(HBSurface)); plug-in component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
hbsurface_10 = HoneybeePlus_HoneybeeSurface(geo=cluster_26.surfaces_2, names=cluster_26.surfacenames_2, type="1", rad_mat=radopaquemat_10)  # -> report, flatten(HB_srf); plug-in component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
hbsrfs_energyplus_9 = Data(flatten(createhbsrfs_9.HBSurface))
hb_srfs_radiance_10 = Data(flatten(hbsurface_10.HB_srf))
boundaries_8 = Data(flatten(cluster_27))
reflectivity_8 = Data(flatten(cluster_25))

python_11 = GhPythonScript(Refresh=bool, MaterialPanel=material_5)  # -> LayerName, Roughness, Thickness, Conductivity, Density, SpecificHeat, ThermalAbsorptivity, SolarAbsorptivity, Porosity; inputs Refresh: Boolean, MaterialPanel: list; same code as python
cluster_28 = Cluster_3(solarabsorptivity=python_11.SolarAbsorptivity)
cluster_29 = Cluster(toplayer=toplayer_2, layername=python_11.LayerName)  # -> surfaces_2, surfacenames_2
epopaquemat_11 = Honeybee_EnergyPlusOpaqueMaterial(
    name=python_11.LayerName,
    roughness=python_11.Roughness,
    thickness=python_11.Thickness,
    conductivity=python_11.Conductivity,
    density=python_11.Density,
    specificHeat=python_11.SpecificHeat,
    thermAbsp=python_11.ThermalAbsorptivity,
    solAbsp=python_11.SolarAbsorptivity,
    visAbsp=python_11.SolarAbsorptivity)  # -> EPMaterial; plug-in component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
epconstruction_11 = Honeybee_EnergyPlusConstruction(name=python_11.LayerName, layer_1=epopaquemat_11)  # -> EPConstruction; plug-in component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
radopaquemat_11 = HoneybeePlus_RadianceOpaqueMaterial(name=graft(python_11.LayerName), reflect=graft(cluster_28), spec=0, rough=0)  # -> simplify(material); plug-in component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
cluster_30 = Cluster_2(surfaces=cluster_29.surfaces_2)
createhbsrfs_10 = Honeybee_createHBSrfs(geometry=cluster_29.surfaces_2, srfName=cluster_29.surfacenames_2, srfType="1", EPConstruction=epconstruction_11)  # -> readMe, simplify(flatten(HBSurface)); plug-in component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
hbsurface_11 = HoneybeePlus_HoneybeeSurface(geo=cluster_29.surfaces_2, names=cluster_29.surfacenames_2, type="1", rad_mat=radopaquemat_11)  # -> report, flatten(HB_srf); plug-in component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
hbsrfs_energyplus_10 = Data(flatten(createhbsrfs_10.HBSurface))
hb_srfs_radiance_11 = Data(flatten(hbsurface_11.HB_srf))
boundaries_9 = Data(flatten(cluster_30))
reflectivity_9 = Data(flatten(cluster_28))

python_12 = GhPythonScript(Refresh=bool, MaterialPanel=material_9)  # -> LayerName, Roughness, Thickness, Conductivity, Density, SpecificHeat, ThermalAbsorptivity, SolarAbsorptivity, Porosity; inputs Refresh: Boolean, MaterialPanel: list; same code as python
cluster_31 = Cluster_3(solarabsorptivity=python_12.SolarAbsorptivity)
cluster_32 = Cluster(toplayer=toplayer_2, layername=python_12.LayerName)  # -> surfaces_2, surfacenames_2
epopaquemat_12 = Honeybee_EnergyPlusOpaqueMaterial(
    name=python_12.LayerName,
    roughness=python_12.Roughness,
    thickness=python_12.Thickness,
    conductivity=python_12.Conductivity,
    density=python_12.Density,
    specificHeat=python_12.SpecificHeat,
    thermAbsp=python_12.ThermalAbsorptivity,
    solAbsp=python_12.SolarAbsorptivity,
    visAbsp=python_12.SolarAbsorptivity)  # -> EPMaterial; plug-in component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
epconstruction_12 = Honeybee_EnergyPlusConstruction(name=python_12.LayerName, layer_1=epopaquemat_12)  # -> EPConstruction; plug-in component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
radopaquemat_12 = HoneybeePlus_RadianceOpaqueMaterial(name=graft(python_12.LayerName), reflect=graft(cluster_31), spec=0, rough=0)  # -> simplify(material); plug-in component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
cluster_33 = Cluster_2(surfaces=cluster_32.surfaces_2)
createhbsrfs_11 = Honeybee_createHBSrfs(geometry=cluster_32.surfaces_2, srfName=cluster_32.surfacenames_2, srfType="1", EPConstruction=epconstruction_12)  # -> readMe, simplify(flatten(HBSurface)); plug-in component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
hbsurface_12 = HoneybeePlus_HoneybeeSurface(geo=cluster_32.surfaces_2, names=cluster_32.surfacenames_2, type="1", rad_mat=radopaquemat_12)  # -> report, flatten(HB_srf); plug-in component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
hbsrfs_energyplus_11 = Data(flatten(createhbsrfs_11.HBSurface))
hb_srfs_radiance_12 = Data(flatten(hbsurface_12.HB_srf))
boundaries_10 = Data(flatten(cluster_33))
reflectivity_10 = Data(flatten(cluster_31))

# ---- group: SHADING SURFACES
python_13 = GhPythonScript(Refresh=bool, MaterialPanel=material_15)  # -> LayerName, Roughness, Thickness, Conductivity, Density, SpecificHeat, ThermalAbsorptivity, SolarAbsorptivity, Porosity; inputs Refresh: Boolean, MaterialPanel: list; same code as python
constantschedule = Honeybee_ConstantSchedule(value=python_13.Porosity, scheduleName=python_13.LayerName)  # -> readMe, schedule, weekSched, schedIDFText; plug-in component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
radglassmaterial = Honeybee_RadianceGlassMaterial(
    materialName=python_13.LayerName,
    RTransmittance=python_13.Porosity,
    GTransmittance=python_13.Porosity,
    BTransmittance=python_13.Porosity,
    refractiveIndex=1.52)  # -> avrgTrans, RADMaterial; plug-in component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
cluster_34 = Cluster(toplayer=toplayer_2, layername=python_13.LayerName)  # -> surfaces_2, surfacenames_2
radglassmat = HoneybeePlus_RadianceGlassMaterial(name=python_13.LayerName, t_vis=python_13.Porosity)  # -> material; plug-in component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
hb_epcontextsrf = HoneybeeEPContextSurfaces(
    shdSurfaces=flatten(cluster_34.surfaces_2),
    EPTransSchedule=constantschedule.schedule,
    RADMaterial=radglassmaterial.RADMaterial)  # -> HBContext; inputs shdSurfaces: list of Brep, justBoundingBox: Boolean
# ---------- hb_epcontextsrf: Python ----------
"""
prepare shading/context geometries

    Args:
        northVectorOrRotation: A vector that shows North or a number that shows
                               the rotation of the North from the Y axis
        bldgMasses: List of closed Breps as thermal zones.
    Returns:
        report: ...
        thermalZones: Thermal zone's geometries for visualiza
"""

ghenv.Component.Name = 'Honeybee EP context Surfaces'
ghenv.Component.NickName = 'HB_EPContextSrf'
ghenv.Component.Message = 'VER 0.0.65\nFEB_06_2020'
ghenv.Component.IconDisplayMode = ghenv.Component.IconDisplayMode.application
ghenv.Component.Category = 'HB-Legacy'
ghenv.Component.SubCategory = "10 | Energy | Energy"
#compatibleHBVersion = VER 0.0.57\nNOV_04_2016
#compatibleLBVersion = VER 0.0.59\nFEB_01_2015
ghenv.Component.AdditionalHelpFromDocStrings = "2"

import rhinoscriptsyntax as rs
import Rhino as rc
import scriptcontext as sc
import os
import System
import Grasshopper.Kernel as gh
import uuid

tolerance = sc.doc.ModelAbsoluteTolerance
import math


def main(shdSurfaces, EPTransSchedule, meshingSettings, justBoundingBox):
    
    # import the classes
    if sc.sticky.has_key('honeybee_release'):

        try:
            if not sc.sticky['honeybee_release'].isCompatible(ghenv.Component): return -1
            if sc.sticky['honeybee_release'].isInputMissing(ghenv.Component): return -1
        except:
            warning = "You need a newer version of Honeybee to use this compoent." + \
            " Use updateHoneybee component to update userObjects.\n" + \
            "If you have already updated userObjects drag Honeybee_Honeybee component " + \
            "into canvas and try again."
            w = gh.GH_RuntimeMessageLevel.Warning
            ghenv.Component.AddRuntimeMessage(w, warning)
            return -1
        
        # don't customize this part
        hb_EPSrf = sc.sticky["honeybee_EPSurface"]
        hb_EPSHDSurface = sc.sticky["honeybee_EPShdSurface"]
        hb_RADMaterialAUX = sc.sticky["honeybee_RADMaterialAUX"]
        hb_EPObjectsAux = sc.sticky["honeybee_EPObjectsAUX"]()
        HBScheduleList = sc.sticky["honeybee_ScheduleLib"].keys()

        ########################################################################
        #----------------------------------------------------------------------#
        shdBreps = []
        # create bounding box of shading geometries
        if justBoundingBox:
            for brep in shdSurfaces:
                if brep.Faces.Count>1 or not brep.Faces[0].IsPlanar(sc.doc.ModelAbsoluteTolerance):
                    shdBreps.append(brep.GetBoundingBox(True).ToBrep())
                else:
                    shdBreps.append(brep)
        else:
            shdBreps = shdSurfaces
        
        shadingClasses = []
        shadingMeshPreview = []
        
        if meshingSettings == None:
            mp = rc.Geometry.MeshingParameters.Minimal
            mp.SimplePlanes = True
        else:
            mp = meshingSettings
        
        def getRadMaterialName(radMaterial):
            nameStr = radMaterial.split(" ")[2]
            name =  nameStr.split("\n")[0]
            return name
        
        for brepCount, brep in enumerate(shdBreps):
            if brep != None:
                isPlanar = True
                # check planarity
                for face in brep.Faces:
                    if not face.IsPlanar(tolerance):
                        isPlanar = False
                        break
                
                shadingBreps = []
                if not isPlanar:
                    meshArray = rc.Geometry.Mesh.CreateFromBrep(brep, mp)
                    for mesh in meshArray:
                        for meshFace in range(mesh.Faces.Count):
                            vertices = list(mesh.Faces.GetFaceVertices(meshFace))[1:]
                            vertices = vertices + [sc.doc.ModelAbsoluteTolerance]
                            # create the brep from mesh
                            shdBrep = rc.Geometry.Brep.CreateFromCornerPoints(*vertices)
                            shadingBreps.append(shdBrep)
                else:
                    for face in brep.Faces:
                        shadingBreps.append(face.DuplicateFace(False))
                
                for faceCount, shdBrep in enumerate(shadingBreps):
                        thisShading = hb_EPSHDSurface(shdBrep, 1000*brepCount + faceCount, 'shdSrf_' + `brepCount` + '_' + `faceCount` + "_" + str(uuid.uuid4()))
                        
                        # add transmittance schedule if any
                        if EPTransSchedule!=None:
                            schedule= EPTransSchedule.upper()
                            if schedule!=None and not schedule.lower().endswith(".csv") and schedule not in HBScheduleList:
                                msg = "Cannot find " + schedule + " in Honeybee schedule library."
                                print msg
                                ghenv.Component.AddRuntimeMessage(gh.GH_RuntimeMessageLevel.Warning, msg)
                                return -1
                            elif schedule!=None and schedule.lower().endswith(".csv"):
                                # check if csv file is existed
                                if not os.path.isfile(schedule):
                                    msg = "Cannot find the shchedule file: " + schedule
                                    print msg
                                    ghenv.Component.AddRuntimeMessage(gh.GH_RuntimeMessageLevel.Warning, msg)
                                    return -1
                            
                            thisShading.TransmittanceSCH = schedule
                        
                        # add the Rad Material if any
                        if RADMaterial!=None:
                            # if it is just the name of the material make sure it is already defined
                            if len(RADMaterial.split(" ")) == 1:
                                # if the material is not in the library add it to the library
                                if not hb_RADMaterialAUX.isMatrialExistInLibrary(RADMaterial):
                                    warningMsg = "Can't find " + RADMaterial + " in RAD Material Library.\n" + \
                                                "Add the material to the library and try again."
                                    ghenv.Component.AddRuntimeMessage(gh.GH_RuntimeMessageLevel.Warning, warningMsg)
                                    return
                                
                                try:
                                    thisShading.setRADMaterial(RADMaterial)
                                except Exception, e:
                                    print e
                                    warningMsg = "You are using an old version of Honeybee_Honeybee! Update your files and try again."
                                    print warningMsg
                                    ghenv.Component.AddRuntimeMessage(gh.GH_RuntimeMessageLevel.Warning, warningMsg)
                                    return
                                
                                addedToLib = True
                            else:
                                
                                # try to add the material to the library
                                addedToLib, thisShading.RadMaterial = hb_RADMaterialAUX.analyseRadMaterials(RADMaterial, True)
                                
                            if addedToLib==False:
                                warningMsg = "Failed to add " + RADMaterial + " to the Library."
                                ghenv.Component.AddRuntimeMessage(gh.GH_RuntimeMessageLevel.Warning, warningMsg)
                                return
                        
                        # add shading to the list
                        shadingClasses.append(thisShading)
                
        # add to the hive
        hb_hive = sc.sticky["honeybee_Hive"]()
        HBContext  = hb_hive.addToHoneybeeHive(shadingClasses, ghenv.Component)
        return HBContext
        ################################################################################################
    else:
        print "You should first let Honeybee to fly..."
        w = gh.GH_RuntimeMessageLevel.Warning
        ghenv.Component.AddRuntimeMessage(w, "You should first let Honeybee to fly...")
        return -1
        

if _shdSurfaces and _shdSurfaces[0]!=None:
    # add cleaning function
    result= main(_shdSurfaces, EPTransSchedule_, meshingSettings_, justBoundingBox_)
    
    if result != -1: HBContext = result
# ---------- end hb_epcontextsrf ----------
hbsurface_13 = HoneybeePlus_HoneybeeSurface(geo=cluster_34.surfaces_2, names=cluster_34.surfacenames_2, type="6", rad_mat=radglassmat)  # -> report, flatten(HB_srf); plug-in component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
hbcontextsrfs_energyplus = Data(flatten(hb_epcontextsrf))
hb_srfs_radiance_13 = Data(flatten(hbsurface_13.HB_srf))

python_14 = GhPythonScript(Refresh=bool, MaterialPanel=material_13)  # -> LayerName, Roughness, Thickness, Conductivity, Density, SpecificHeat, ThermalAbsorptivity, SolarAbsorptivity, Porosity; inputs Refresh: Boolean, MaterialPanel: list; same code as python
constantschedule_2 = Honeybee_ConstantSchedule(value=python_14.Porosity, scheduleName=python_14.LayerName)  # -> readMe, schedule, weekSched, schedIDFText; plug-in component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
radglassmaterial_2 = Honeybee_RadianceGlassMaterial(
    materialName=python_14.LayerName,
    RTransmittance=python_14.Porosity,
    GTransmittance=python_14.Porosity,
    BTransmittance=python_14.Porosity,
    refractiveIndex=1.52)  # -> avrgTrans, RADMaterial; plug-in component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
cluster_35 = Cluster(toplayer=toplayer_2, layername=python_14.LayerName)  # -> surfaces_2, surfacenames_2
radglassmat_2 = HoneybeePlus_RadianceGlassMaterial(name=python_14.LayerName, t_vis=python_14.Porosity)  # -> material; plug-in component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
hb_epcontextsrf_2 = HoneybeeEPContextSurfaces(
    shdSurfaces=flatten(cluster_35.surfaces_2),
    EPTransSchedule=constantschedule_2.schedule,
    RADMaterial=radglassmaterial_2.RADMaterial)  # -> HBContext; inputs shdSurfaces: list of Brep, justBoundingBox: Boolean; same code as hb_epcontextsrf
hbsurface_14 = HoneybeePlus_HoneybeeSurface(geo=cluster_35.surfaces_2, names=cluster_35.surfacenames_2, type="6", rad_mat=radglassmat_2)  # -> report, flatten(HB_srf); plug-in component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
hbcontextsrfs_energyplus_2 = Data(flatten(hb_epcontextsrf_2))
hb_srfs_radiance_14 = Data(flatten(hbsurface_14.HB_srf))

python_15 = GhPythonScript(Refresh=bool, MaterialPanel=material_14)  # -> LayerName, Roughness, Thickness, Conductivity, Density, SpecificHeat, ThermalAbsorptivity, SolarAbsorptivity, Porosity; inputs Refresh: Boolean, MaterialPanel: list; same code as python
constantschedule_3 = Honeybee_ConstantSchedule(value=python_15.Porosity, scheduleName=python_15.LayerName)  # -> readMe, schedule, weekSched, schedIDFText; plug-in component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
radglassmaterial_3 = Honeybee_RadianceGlassMaterial(
    materialName=python_15.LayerName,
    RTransmittance=python_15.Porosity,
    GTransmittance=python_15.Porosity,
    BTransmittance=python_15.Porosity,
    refractiveIndex=1.52)  # -> avrgTrans, RADMaterial; plug-in component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
cluster_36 = Cluster(toplayer=toplayer_2, layername=python_15.LayerName)  # -> surfaces_2, surfacenames_2
radglassmat_3 = HoneybeePlus_RadianceGlassMaterial(name=python_15.LayerName, t_vis=python_15.Porosity)  # -> material; plug-in component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
hb_epcontextsrf_3 = HoneybeeEPContextSurfaces(
    shdSurfaces=flatten(cluster_36.surfaces_2),
    EPTransSchedule=constantschedule_3.schedule,
    RADMaterial=radglassmaterial_3.RADMaterial)  # -> HBContext; inputs shdSurfaces: list of Brep, justBoundingBox: Boolean; same code as hb_epcontextsrf
hbsurface_15 = HoneybeePlus_HoneybeeSurface(geo=cluster_36.surfaces_2, names=cluster_36.surfacenames_2, type="6", rad_mat=radglassmat_3)  # -> report, flatten(HB_srf); plug-in component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
hbcontextsrfs_energyplus_3 = Data(flatten(hb_epcontextsrf_3))
hb_srfs_radiance_15 = Data(flatten(hbsurface_15.HB_srf))

# ----
epluspath = FilePath(e_executable_path)

# ---- group: COMBINE GEOMETRIES
merge_groundhbsurfaces = Merge(
    Data1=hbsrfs_energyplus_2,
    Data2=hbsrfs_energyplus_6,
    Data3=hbsrfs_energyplus_11,
    Data4=hbsrfs_energyplus_8,
    Data5=hbsrfs_energyplus,
    Data6=hbsrfs_energyplus_5,
    Data7=hbsrfs_energyplus_7,
    Data8=hbsrfs_energyplus_9,
    Data9=hbsrfs_energyplus_10,
    Data10=hbsrfs_energyplus_4,
    Data11=hbsrfs_energyplus_3)  # -> flatten(Result)
merge_hb_srfs = Merge(
    Data1=hb_srfs_radiance,
    Data2=hb_srfs_radiance_3,
    Data3=hb_srfs_radiance_7,
    Data4=hb_srfs_radiance_12,
    Data5=hb_srfs_radiance_9,
    Data6=hb_srfs_radiance_15,
    Data7=hb_srfs_radiance_14,
    Data8=hb_srfs_radiance_2,
    Data9=hb_srfs_radiance_6,
    Data10=hb_srfs_radiance_8,
    Data11=hb_srfs_radiance_10,
    Data12=hb_srfs_radiance_11,
    Data14=hb_srfs_radiance_13,
    Data15=hb_srfs_radiance_5,
    Data16=hb_srfs_radiance_4)  # -> flatten(Result)
merge_hbcontext = Merge(Data1=hbcontextsrfs_energyplus_3, Data2=hbcontextsrfs_energyplus_2, Data4=hbcontextsrfs_energyplus)  # -> flatten(Result)
toggle = BooleanToggle(True)
toggle_2 = BooleanToggle(True)
toggle_3 = BooleanToggle(True)
clean = CleanTree(RemoveNulls=toggle, RemoveInvalid=toggle, RemoveEmpty=toggle, Tree=merge_hb_srfs)
clean_2 = CleanTree(RemoveNulls=toggle_3, RemoveInvalid=toggle_3, RemoveEmpty=toggle_3, Tree=merge_hbcontext)
clean_3 = CleanTree(RemoveNulls=toggle_2, RemoveInvalid=toggle_2, RemoveEmpty=toggle_2, Tree=merge_groundhbsurfaces)
createhbzones = Honeybee_createHBZones(name="GROUND_ZONE", HBSurfaces=flatten(clean_3), isConditioned=Toggle(False))  # -> readMe, HBZone; plug-in component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
merge_hbzones = Merge(Data1=hbzones_energyplus, Data2=createhbzones.HBZone)  # -> flatten(Result)
toggle_4 = BooleanToggle(True)
clean_4 = CleanTree(RemoveNulls=toggle_4, RemoveInvalid=toggle_4, RemoveEmpty=toggle_4, Tree=merge_hbzones)
hbzones = Data(flatten(clean_4))
hbcontext = Data(flatten(clean_2))
hb_srfs = Data(flatten(clean))

# ----
outputdirectory_2 = Text(outputdirectory)
weatherfile_3 = FilePath(weatherfile_2)

toggle_5 = BooleanToggle(True)
runeplusfilegeneration = Boolean(toggle_5)
runradiancefilegeneration = Boolean(toggle_5)

# ---- group: Generate EnergyPlus surface temperature model
toggle_6 = BooleanToggle(False)
simcontrol = Honeybee_SimulationControl(
    doZoneSizingCalculation=toggle_6,
    doSystemSizingCalculation=toggle_6,
    doPlantSizingCalculation=toggle_6,
    runSimForSizingPeriods=toggle_6,
    runSimForRunPeriods=Toggle(True))  # -> simControls; plug-in component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
importgroundtemp = Ladybug_ImportGroundTemp(epwFile=weatherfile_3)  # -> readMe, groundtemp1st, groundtemp2nd, groundtemp3rd, profileCrvs, crvColors, graphAxes, graphtext, Legend; plug-in component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
shadowpar = Honeybee_ShadowPar(calculationMethod="TimestepFrequency", frequency="1", maximumFigure="1000")  # -> shadowPar; plug-in component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
panel_2 = Panel("""OutputControl:Table:Style,Comma;
Output:Variable,*,Surface Outside Face Temperature, hourly;
Output:Diagnostics,DisplayExtraWarnings;""")
strnum = Ladybug_SeparateData(inputList=flatten(importgroundtemp.groundtemp1st))  # -> numbers, strings; plug-in component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
energysimpar = Honeybee_EnergySimulationPar(
    timestep=6,
    shadowCalcPar=shadowpar,
    solarDistribution="3",
    simulationControls=simcontrol,
    terrain="0",
    monthlyGrndTemps=strnum.numbers)  # -> energySimPar; plug-in component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
exporttoopenstudio = Honeybee_ExportToOpenStudio(
    epwWeatherFile=weatherfile_3,
    energySimPar=energysimpar,
    HBZones=flatten(hbzones),
    HBContext=flatten(hbcontext),
    simulationOutputs=flatten(panel_2),
    writeOSM=runeplusfilegeneration,
    runSimulation="3",
    fileName=toplayer_2,
    workingDir=outputdirectory_2)  # -> readMe, osmFileAddress, idfFileAddress, resultFileAddress, eioFileAddress, rddFileAddress, htmlReport, studyFolder, model; plug-in component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
modifygrass_underground = GhPythonScript(originalFile=exporttoopenstudio.idfFileAddress, rewrite=Toggle(True))  # -> idfAddress; inputs rewrite: Boolean
# ---------- modifygrass_underground: Python ----------
import os, re

# Read original file
with open(_originalFile, "r") as f:
    data = f.read()

# Replace whitespace between values and comments
test = re.sub("\s+!", "!", data)

# Replace grass material
test = re.sub(
    "Material,\n  GND_GRASS,!- Name\n  Rough,!- Roughness\n  0.2,!- Thickness {m}\n  1,!- Conductivity {W/m-K}\n  1250,!- Density {kg/m3}\n  1252,!- Specific Heat {J/kg-K}\n  0.92,!- Thermal Absorptance\n  0.75,!- Solar Absorptance\n  0.7;!- Visible Absorptance", 
    "Material:RoofVegetation,\n  GND_GRASS,!- Name\n  0.05,!- Height of Plants\n  1.71,!- Leaf Area Index\n  0.19,!- Leaf Reflectivity\n  0.95,!- Leaf Emissivity\n  180,!- Minimum Stomatal Resistance\n  Soil,!- Soil Layer Name\n  Rough,!- Roughness\n  0.2,!- Thickness\n  1,!- Conductivity of Dry Soil\n  1250,!- Density of Dry Soil\n  1252,!- Specific Heat of Dry Soil\n  0.92,!- Thermal Absorptance\n  0.75,!- Solar Absorptance\n  0.75,!- Visible Absorptance\n  0.3,!- Saturation Volumetric Moisture Content of the Soil Layer\n  0.01,!- Residual Volumetric Moisture Content of the Soil Layer\n  0.1,!- Initial Volumetric Moisture Content of the Soil Layer\n  Simple;!- Moisture Diffusion Calculation Method", 
    test
)

# Replace grass material
test = re.sub(
    "Material,\n  GND_VEGETATION,!- Name\n  Rough,!- Roughness\n  0.2,!- Thickness {m}\n  1,!- Conductivity {W/m-K}\n  1250,!- Density {kg/m3}\n  1252,!- Specific Heat {J/kg-K}\n  0.92,!- Thermal Absorptance\n  0.75,!- Solar Absorptance\n  0.7;!- Visible Absorptance", 
    "Material:RoofVegetation,\n  GND_VEGETATION,!- Name\n  0.25,!- Height of Plants\n  2.08,!- Leaf Area Index\n  0.21,!- Leaf Reflectivity\n  0.95,!- Leaf Emissivity\n  180,!- Minimum Stomatal Resistance\n  Soil,!- Soil Layer Name\n  Rough,!- Roughness\n  0.2,!- Thickness\n  0.5,!- Conductivity of Dry Soil\n  1600,!- Density of Dry Soil\n  1026,!- Specific Heat of Dry Soil\n  0.9,!- Thermal Absorptance\n  0.7,!- Solar Absorptance\n  0.7,!- Visible Absorptance\n  0.3,!- Saturation Volumetric Moisture Content of the Soil Layer\n  0.01,!- Residual Volumetric Moisture Content of the Soil Layer\n  0.1,!- Initial Volumetric Moisture Content of the Soil Layer\n  Simple;!- Moisture Diffusion Calculation Method", 
    test
)

# Make underground surfaces ground-adjacent
test = re.sub(
    "  GND_SURROUNDING,!- Construction Name\n  GROUND_ZONE,!- Zone Name\n  Outdoors,!- Outside Boundary Condition\n  ,!- Outside Boundary Condition Object\n  Nosun,!- Sun Exposure\n  Nowind,!- Wind Exposure", 
    "  GND_SURROUNDING,!- Construction Name\n  GROUND_ZONE,!- Zone Name\n  Ground,!- Outside Boundary Condition\n  ,!- Outside Boundary Condition Object\n  Nosun,!- Sun Exposure\n  Nowind,!- Wind Exposure", 
    test
)
test = re.sub(
    "  GND_SURROUNDING,!- Construction Name\n  GROUND_ZONE,!- Zone Name\n  Outdoors,!- Outside Boundary Condition\n  ,!- Outside Boundary Condition Object\n  Sunexposed,!- Sun Exposure\n  Windexposed,!- Wind Exposure", 
    "  GND_SURROUNDING,!- Construction Name\n  GROUND_ZONE,!- Zone Name\n  Ground,!- Outside Boundary Condition\n  ,!- Outside Boundary Condition Object\n  Nosun,!- Sun Exposure\n  Nowind,!- Wind Exposure", 
    test
)

# Rewrite the IDF file
if _rewrite:
    with open(_originalFile, "w") as f:
        f.write(test)
    idfAddress = _originalFile
# ---------- end modifygrass_underground ----------
createbat = GhPythonScript(epwPath=weatherfile_3, eplusPath=epluspath, idfPath=modifygrass_underground)  # -> command
# ---------- createbat: Python ----------
import rhinoscriptsyntax as rs
import os, json

# Create EnergyPlus run command
#idf_path = os.path.join(_outputDir, _caseName, "OpenStudio", _caseName, "ModelToIdf", "in.idf").replace("\\", "/")
#idf_output_dir = os.path.join(_outputDir, _caseName, "OpenStudio", _caseName, "ModelToIdf").replace("\\", "/")
#eplus_output_path = os.path.join(_outputDir, _caseName, "OpenStudio", _caseName, "ModelToIdf", "eplusout.csv").replace("\\", "/")
#eplus_command = '"{0:}" -a -r -x -d "{3:}" -w "{1:}" "{2:}"'.format(_eplusPath.replace("\\", "/"), _epwFile, idf_path, idf_output_dir)

# Base path for batch file
bat_dir = os.path.dirname(os.path.dirname(os.path.dirname(os.path.dirname(_idfPath))))
_batPath = os.path.join(bat_dir, "run_eplus.bat")

# Output directory for eplus run
eplus_out_dir = os.path.dirname(_idfPath)

# Command string to write to BAT
eplus_command = '"{0:}" -a -r -x -d "{3:}" -w "{1:}" "{2:}"'.format(_eplusPath, _epwPath, _idfPath, eplus_out_dir).replace("\\", "/")

# Write BAT file
with open(_batPath, "w") as f:
    f.write(eplus_command)

command = eplus_command
# ---------- end createbat ----------

# ----
tree_canopy_density = Slider(140, range=100..500)  # disabled
leaf_size = Panel("0.65")  # disabled
treeclosedpolysurfs = Brep([<brep referenced from the Rhino model> x26])  # disabled
bbox = BoundingBox(Content=treeclosedpolysurfs, Plane=PlaneXY(0, 0, 0))  # -> Box, Box_2; disabled
debox = DeconstructBox(Box=bbox.Box)  # -> Plane, X, Y, Z; disabled
volume = Volume(Geometry=treeclosedpolysurfs)  # -> Volume, Centroid; disabled
dedomain = DeconstructDomain(Domain=debox.X)  # -> Start, End; disabled
dedomain_2 = DeconstructDomain(Domain=debox.Y)  # -> Start, End; disabled
dedomain_3 = DeconstructDomain(Domain=debox.Z)  # -> Start, End; disabled
subtraction = Subtraction(A=dedomain.End, B=dedomain.Start)  # disabled
subtraction_2 = Subtraction(A=dedomain_2.End, B=dedomain_2.Start)  # disabled
subtraction_3 = Subtraction(A=dedomain_3.End, B=dedomain_3.Start)  # disabled
consvolbox = ConstrainedVolumeBox(Plane=volume.Centroid, Volume=volume.Volume, FactorX=subtraction, FactorY=subtraction_2, FactorZ=subtraction_3)  # -> Box, DimensionX, DimensionY, DimensionZ; disabled
panel_3 = Panel("0 to 100")  # disabled
lng_2 = ListLength(List=treeclosedpolysurfs)  # disabled
random = Random(Range=panel_3, Number=lng_2, Seed=2)  # disabled
pop3d = Populate3D(Region=treeclosedpolysurfs, Count=tree_canopy_density, Seed=random)  # -> simplify(Population); disabled
brepinc = PointInBrep(Brep=graft(consvolbox.Box), Point=pop3d, Strict=False)  # disabled
dispatch = Dispatch(List=pop3d, DispatchPattern=brepinc)  # -> simplify(ListA), ListB; disabled
pt = Point(dispatch.ListA)  # disabled
lng_3 = ListLength(List=pt)  # disabled
button = Button()  # disabled
python_16 = GhPythonScript(reroll=button, n=flatten(lng_3))  # -> simplify(vectors); inputs reroll: Boolean, n: list; disabled
# ---------- python_16: Python ----------
import random

import ghpythonlib.treehelpers as th
import Rhino
import rhinoscriptsyntax as rs

# For each number of vectors, create a randomised vector
vectors = []
for i in n:
    temp = []
    for j in range(i):
        temp.append(rs.AddPoint(random.uniform(0, 1), random.uniform(0, 1), random.uniform(0, 1)))
    vectors.append(temp)

vectors = th.list_to_tree(vectors, source=[0, 0])
# ---------- end python_16 ----------
panel_4 = Panel("""0
120
240""")  # disabled
pl = PlaneNormal(Origin=pt, ZAxis=python_16)  # disabled
rad = Radians(Degrees=panel_4)  # disabled
prot = RotatePlane(Plane=graft(pl), Angle=rad)  # disabled
toggle_7 = BooleanToggle(True)  # disabled
pt_2 = PointOriented(BasePlane=prot, UComponent=leaf_size, VComponent=0, WComponent=0)  # disabled
pline = PolyLine(Vertices=pt_2, Closed=toggle_7)  # disabled
mesh = MeshBrep(
    Brep=pline,
    Settings={GridMaxCount=0, GridMinCount=16, JaggedSeams=False, MaxEdgeLength=0, MinEdgeLength=0.0001, MinTolerance=0, Refine=True, RefineAngle=0, RelativeTolerance=0.65, SimplePlanes=True, Tolerance=0})  # disabled
path_mapper = PathMapper(mesh, source="{A;B}", target="{A}")  # disabled
boundary = BoundarySurfaces(Edges=pline)  # disabled
path_mapper_2 = PathMapper(boundary, source="{A;B}", target="{A}")  # disabled
mjoin = MeshJoin(Meshes=path_mapper)  # -> flatten(Mesh); disabled
preview = CustomPreview(
    Geometry=path_mapper_2,
    Material={diffuse=RGB(221, 160, 221), emission=RGB(66, 48, 66), shine=0.5, specular=RGB(255, 255, 255), transparency=0})  # disabled

# ----
# Donut surfaces - get rid o' these
edges = BrepEdges(Brep=clean_3)  # -> Naked, Interior, NonManifold; disabled
toggle_8 = BooleanToggle(False)  # disabled
join = JoinCurves(Curves=edges.Naked, Preserve=toggle_8)  # disabled
simplify = SimplifyCurve(Curve=join)  # -> simplify(Curve), Simplified; disabled
lng_4 = ListLength(List=simplify.Curve)  # disabled
panel_5 = Panel("1")  # disabled
larger = LargerThan(FirstNumber=flatten(lng_4), SecondNumber=panel_5)  # -> LargerThan, OrEqualTo; disabled
dispatch_2 = Dispatch(List=clean_3, DispatchPattern=larger.LargerThan)  # -> ListA, ListB; disabled
swatch = ColourSwatch(SwatchColor=RGB(255, 0, 0))  # disabled
donutsurfaces = CustomPreview(Geometry=dispatch_2.ListA, Material=swatch)  # disabled

swatch_2 = ColourSwatch(SwatchColor=RGB(255, 0, 0))  # disabled

# ----
# Small area surfaces - try to avoid these
number_slider = Slider(4, range=0..20)  # disabled
area = Area(Geometry=clean_3)  # -> Area, Centroid; disabled
series_2 = Series(Start=0, Step=1, Count=number_slider)  # disabled
sort = SortList(Keys=area.Area, ValuesA=clean_3)  # -> Keys, ValuesA; disabled
item = ListItem(List=sort.ValuesA, Index=series_2, Wrap=True)  # disabled
area_2 = Area(Geometry=item)  # -> Area, Centroid; disabled
panel_6 = Panel("0.5")  # disabled
dots = DotDisplay(Point=area_2.Centroid, Colour=swatch_2, Size=panel_6)  # disabled

# ---- group: Create sample vectors
n_samples = Panel("1000")  # disabled
panel_7 = Panel("1000")  # disabled
fibonaccisphere_py = GhPythonScript(nPoints=n_samples, scale=panel_7)  # -> points; inputs nPoints: Int32, anchor: Point3d; disabled
# ---------- fibonaccisphere_py: Python ----------
__author__ = "tgerrish"
__version__ = "2020.05.22"

import rhinoscriptsyntax as rs
import math

# Translation to anchor point
if anchor is None:
    anchor = rs.CreatePoint(0, 0, 0)
basePt = rs.CreatePoint(0, 0, 0)
translationVector = anchor - basePt
print(translationVector)

indices = [i + 0.5 for i in range(0, nPoints)]
phi = [math.acos(1 - 2 * i / nPoints) for i in indices]
theta = [math.pi * (1 + 5 ** 0.5) * i for i in indices]
x = [translationVector.X + ((math.cos(theta[n]) * math.sin(phi[n])) * scale) for n in range(nPoints)]
y = [translationVector.Y + ((math.sin(theta[n]) * math.sin(phi[n])) * scale) for n in range(nPoints)]
z = [translationVector.Z + ((math.cos(phi[n])) * scale) for n in range(nPoints)]

points = []
for i, j, k in list(zip(*[x, y, z])):
    points.append(rs.AddPoint([i, j, k]))

#if abs(translationVector.X) + abs(translationVector.Y) + abs(translationVector.Z) != 0:
# ---------- end fibonaccisphere_py ----------
samplevectors = Vector(fibonaccisphere_py)  # disabled

# ----
debrep_2 = DeconstructBrep(Brep=[hbzones, hbcontext])  # -> flatten(Faces), Edges, Vertices; disabled
skyviewfactorcontext = Surface(flatten(debrep_2.Faces))  # disabled

blockingobjects = Brep(hbcontext)  # disabled
srftempobjects = Brep(hbzones)  # disabled
samplevectors_2 = Vector(fibonaccisphere_py)  # disabled
hbcontext_2 = Data(flatten(hbcontext))
debrep_3 = DeconstructBrep(Brep=blockingobjects)  # -> flatten(Faces), Edges, Vertices; disabled
debrep_4 = DeconstructBrep(Brep=srftempobjects)  # -> flatten(Faces), Edges, Vertices; disabled
viewer = ParamViewer(debrep_4.Faces)  # disabled
viewer_2 = ParamViewer(samplevectors_2)  # disabled
viewer_3 = ParamViewer(debrep_3.Faces)  # disabled
mjoin_2 = MeshJoin(Meshes=debrep_4.Faces)  # disabled
mjoin_3 = MeshJoin(Meshes=debrep_3.Faces)  # disabled
mjoin_4 = MeshJoin(Meshes=[debrep_4.Faces, debrep_3.Faces])  # disabled

# ---- group: ANALYSIS POINTS
list_2 = ValueList({"All objects": 0, "Point": 1, "Point cloud": 2, "Curve": 4, "Surface or single-face brep": 8, "Polysurface or multiple-face": 16, "Mesh": 32, "Light": 256, "Annotation": 512, "Instance or block reference": 4096, "Text dot object": 8192, "Grip object": 16384, "Detail": 32768, "Hatch": 65536, "Morph control": 131072, "Cage": 134217728, "Phantom": 268435456, "Clipping plane": 536870912, "Extrusion": 1073741824}, selected="Polysurface or multiple-face")
panel_8 = Panel("ANALYSIS_REGION")
cluster_37 = Cluster_4(case=toplayer_2, layer="ANALYSIS_PLANE", geometrytype=panel, refresh=bool)
Z = UnitZ(Factor="100")

# ----
cluster_38 = Cluster_4(case=toplayer_2, layer=panel_8, geometrytype=panel, refresh=bool)

# ---- group: ANALYSIS POINTS (continued)
edges_2 = BrepEdges(Brep=cluster_38)  # -> Naked, Interior, NonManifold
move = Move(Geometry=cluster_38, Motion=Z)  # -> Geometry, Transform
join_2 = JoinCurves(Curves=edges_2.Naked, Preserve=False)
cp = ControlPoints(Curve=join_2)  # -> flatten(Points), Weights, Knots
genpts = LBGeneratePointGrid(geometry=move.Geometry, grid_size="1", dist_surface="0")  # -> points, vectors, face_areas, mesh; plug-in component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
lng_5 = ListLength(List=cp.Points)
subtraction_4 = Subtraction(A=lng_5, B="1")
project = ProjectPoint(Point=genpts.points, Direction=Vector(0, 0, -1), Geometry=cluster_37)  # -> Point, Index
split = SplitList(List=cp.Points, Index=subtraction_4)  # -> ListA, ListB
analysisregionboundaryvertices = Point(flatten(split.ListA))
analysispoints = Point(flatten(project.Point))

# ----
cloud = CloudDisplay(Points=analysispoints, Colours=RGB(255, 20, 147), Size=1, SpriteType=0)

# ---- group: ANALYSIS POINT GROUND REFLECTIVITIES
# TODO
# - Remove duplicate points and ground reflectivities from this part
entwine_reflectivities = Entwine(
    Branch00=reflectivity,
    Branch01=reflectivity_5,
    Branch02=reflectivity_10,
    Branch03=reflectivity_4,
    Branch04=reflectivity_7,
    Branch05=reflectivity_6,
    Branch06=reflectivity_8,
    Branch07=reflectivity_9,
    Branch08=reflectivity_3,
    Branch09=reflectivity_2,
    FlattenInputs=True)  # -> simplify(Result)
entwine_boundaries = Entwine(
    Branch00=boundaries,
    Branch01=boundaries_5,
    Branch02=boundaries_10,
    Branch03=boundaries_4,
    Branch04=boundaries_7,
    Branch05=boundaries_6,
    Branch06=boundaries_8,
    Branch07=boundaries_9,
    Branch08=boundaries_3,
    Branch09=boundaries_2,
    FlattenInputs=True)  # -> simplify(Result)
null = NullItem(Item=entwine_boundaries)  # -> NullFlags, InvalidFlags, Description
toggle_9 = BooleanToggle(True)
ma = MassAddition(Input=null.InvalidFlags)  # -> flatten(Result), PartialResults
cull = CullPattern(List=entwine_boundaries, CullPattern=invert(null.InvalidFlags))
equals = Equality(FirstNumber="0", SecondNumber=ma.Result)  # -> Equality, Inequality
clean_5 = CleanTree(RemoveNulls=toggle_9, RemoveInvalid=toggle_9, RemoveEmpty=toggle_9, Tree=cull)
dispatch_3 = Dispatch(List=flatten(entwine_reflectivities), DispatchPattern=equals.Equality)  # -> ListA, ListB
project_2 = Project(Geometry=clean_5, Plane=PlaneXY(0, 0, 0))  # -> Geometry, Transform
incurve = PointInCurve(Point=analysispoints, Curve=graft(project_2.Geometry))  # -> simplify(Relationship), Point
lng_6 = ListLength(List=project_2.Geometry)  # -> flatten(Length)
dup = DuplicateData(Data=graft(dispatch_3.ListA), Number=graft(lng_6), Order=True)  # -> flatten(Data)
larger_2 = LargerThan(FirstNumber=incurve.Relationship, SecondNumber="1")  # -> LargerThan, OrEqualTo
dispatch_4 = Dispatch(List=analysispoints, DispatchPattern=larger_2.OrEqualTo)  # -> simplify(ListA), ListB
lng_7 = ListLength(List=simplify(dispatch_4.ListA))
dup_2 = DuplicateData(Data=simplify(graft(dup)), Number=simplify(graft(lng_7)), Order=True)
pt_3 = Point(dispatch_4.ListA)
point_ground_reflectivities = Data(flatten(dup_2))
analysispoints_2 = Point(flatten(pt_3))

# ----
lng_8 = ListLength(List=analysispoints_2)
panel_9 = Panel(lng_8)

# ---- group: CREATE RADIANCE CASE
wea = HoneybeePlus_WEAFromEPW(epw_file=weatherfile_3)  # -> wea; plug-in component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
analysisgrid = HoneybeePlus_AnalysisGrid(test_points=analysispoints_2)  # -> analysis_grid; plug-in component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
skymatrix = HoneybeePlus_SkyMatrix(north=0, wea=wea, density=1)  # -> skymtx; plug-in component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
annualdlrecipe = HoneybeePlus_AnnualDaylightRecipe(skymtx=skymatrix, analysis_grids=analysisgrid, analysis_type="1", reuse_dmtx=Toggle(True))  # -> analysis_recipe; plug-in component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
runradiance = HoneybeePlus_RunRadianceAnalysis(
    analysis_recipe=annualdlrecipe,
    HB_objects=hb_srfs,
    folder=outputdirectory_2,
    name=toplayer_2,
    write=runradiancefilegeneration)  # -> report, legend_par, outputs; plug-in component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
createbat_2 = GhPythonScript(HB_report=runradiance.report)  # -> command; inputs HB_report: list
# ---------- createbat_2: Python ----------
import os

# Base path for batch file
base_path = os.path.dirname(HB_report[3].replace("Writing recipe contents to: ", ""))
_batPath = os.path.join(base_path, "run_radiance.bat")
ref_bat_path = os.path.join(base_path, "gridbased_annual", "commands.bat")

# Write BAT file
with open(_batPath, "w") as f:
    f.write(ref_bat_path)

command = ref_bat_path
# ---------- end createbat_2 ----------

# ----
# Create a grid over the analysis region - for splitting ground surfaces
analysis_region = Brep(cluster_38)  # disabled
debrep_5 = DeconstructBrep(Brep=analysis_region)  # -> Faces, Edges, Vertices; disabled
join_3 = JoinCurves(Curves=debrep_5.Edges, Preserve=False)  # disabled
area_3 = Area(Geometry=debrep_5.Faces)  # -> Area, Centroid; disabled
panel_10 = Panel("2.5")  # disabled
evalsrf = EvaluateSurface(Surface=debrep_5.Faces, Point=area_3.Centroid)  # -> Point, Normal, UDirection, VDirection, Frame; disabled
offset = OffsetCurve(Curve=join_3, Distance=panel_10, Plane=PlaneXY(0, 0, 0), Corners=1)  # disabled
pl_2 = ConstructPlane(Origin=evalsrf.Point, XAxis=evalsrf.UDirection, YAxis=evalsrf.VDirection)  # disabled
bbox_2 = BoundingBox(Content=debrep_5.Faces, Plane=pl_2)  # -> Box, Box_2; disabled
panel_11 = Panel("1.2")  # disabled
number_slider_2 = Slider(14, range=1..25)  # disabled
scale = Scale(Geometry=bbox_2.Box, Center=area_3.Centroid, Factor=panel_11)  # -> Geometry, Transform; disabled
number_slider_3 = Slider(20, range=1..25)  # disabled
debrep_6 = DeconstructBrep(Brep=scale.Geometry)  # -> Faces, Edges, Vertices; disabled
divide = DivideDomain²(Domain=debrep_6.Faces, UCount=number_slider_3, VCount=number_slider_2)  # disabled
subsrf = Isotrim(Surface=debrep_6.Faces, Domain=divide)  # disabled
srfsplit = SurfaceSplit(Surface=subsrf, Curves=offset)  # disabled
item_2 = ListItem(List=simplify(srfsplit), Index=0, Wrap=True)  # -> flatten(Item); disabled
area_4 = Area(Geometry=item_2)  # -> Area, Centroid; disabled
incurve_2 = PointInCurve(Point=area_4.Centroid, Curve=offset)  # -> Relationship, Point; disabled
panel_12 = Panel("2")  # disabled
equals_2 = Equality(FirstNumber=incurve_2.Relationship, SecondNumber=panel_12)  # -> Equality, Inequality; disabled
dispatch_5 = Dispatch(List=item_2, DispatchPattern=equals_2.Equality)  # -> ListA, ListB; disabled
edges_3 = BrepEdges(Brep=dispatch_5.ListA)  # -> Naked, Interior, NonManifold; disabled
join_4 = JoinCurves(Curves=edges_3.Naked, Preserve=False)  # disabled
gridcurves = Curve(flatten(join_4))  # disabled

# ---- group: Sky exposure for each sample point
pdecon = Deconstruct(Point=samplevectors)  # -> XComponent, YComponent, ZComponent; disabled
panel_13 = Panel("0")  # disabled
smaller = SmallerThan(FirstNumber=pdecon.ZComponent, SecondNumber=panel_13)  # -> SmallerThan, OrEqualTo; disabled
dispatch_6 = Dispatch(List=samplevectors, DispatchPattern=smaller.SmallerThan)  # -> ListA, ListB; disabled
skywardvectors = Vector(dispatch_6.ListB)  # disabled
mjoin_5 = MeshJoin(Meshes=flatten(skyviewfactorcontext))  # disabled
meshray = MeshRay(Mesh=mjoin_5, Point=graft(analysispoints_2), Direction=skywardvectors)  # -> Point, Hit; disabled
lng_9 = ListLength(List=skywardvectors)  # disabled
ma_2 = MassAddition(Input=meshray.Hit)  # -> Result, PartialResults; disabled
division = Division(A=ma_2.Result, B=lng_9)  # -> flatten(Result); disabled
panel_14 = Panel("1")  # disabled
subtraction_5 = Subtraction(A=panel_14, B=division)  # disabled
ptskyexposure = Data(subtraction_5)  # disabled

# ----
# UNDER DEVELOPMENT
# Moving Surface View Factor into pure GH
calculatedsrftempobjects = Brep(hbzones)  # disabled
shadeobjects = Brep(hbcontext)  # disabled
samplevectors_3 = Vector()  # disabled
samplepoints = Point(analysispoints_2)  # disabled
debrep_7 = DeconstructBrep(Brep=shadeobjects)  # -> Faces, Edges, Vertices; disabled
debrep_8 = DeconstructBrep(Brep=calculatedsrftempobjects)  # -> Faces, Edges, Vertices; disabled
simplify_2 = SimplifyTree(Tree=debrep_8.Faces, Front=False)  # disabled
simplify_3 = SimplifyTree(Tree=debrep_7.Faces, Front=False)  # disabled
graft = GraftTree(Tree=simplify_2, IncludeEmptyLists=True, IncludeNullItems=True)  # disabled
meshray_2 = MeshRay(Mesh=simplify_3, Point=samplepoints, Direction=samplevectors_3)  # -> Point, Hit; disabled
graft_2 = GraftTree(Tree=debrep_7.Faces, IncludeEmptyLists=True, IncludeNullItems=True)  # disabled
graft_3 = GraftTree(Tree=debrep_8.Faces, IncludeEmptyLists=True, IncludeNullItems=True)  # disabled
meshray_3 = MeshRay(Mesh=graft, Point=samplepoints, Direction=graft(samplevectors_3))  # -> Point, Hit; disabled
graft_4 = GraftTree(Tree=graft_2, IncludeEmptyLists=True, IncludeNullItems=True)  # disabled
graft_5 = GraftTree(Tree=graft_3, IncludeEmptyLists=True, IncludeNullItems=True)  # disabled
viewer_4 = ParamViewer(meshray_3.Point)  # disabled
edges_4 = BrepEdges(Brep=debrep_8.Faces)  # -> Naked, Interior, NonManifold; disabled
join_5 = JoinCurves(Curves=edges_4.Naked, Preserve=False)  # -> flatten(Curves); disabled
mjoin_6 = MeshJoin(Meshes=debrep_7.Faces)  # disabled
mjoin_7 = MeshJoin(Meshes=debrep_8.Faces)  # disabled
mjoin_8 = MeshJoin(Meshes=[mjoin_7, mjoin_6])  # disabled
meshray_4 = MeshRay(Mesh=graft(mjoin_6), Point=graft(samplepoints), Direction=samplevectors_3)  # -> Point, Hit; disabled
meshray_5 = MeshRay(Mesh=graft_2, Point=graft(samplepoints), Direction=samplevectors_3)  # -> Point, Hit; disabled
meshray_6 = MeshRay(Mesh=graft(mjoin_8), Point=graft(samplepoints), Direction=samplevectors_3)  # -> Point, Hit; disabled
meshray_7 = MeshRay(Mesh=graft(mjoin_7), Point=graft(samplepoints), Direction=samplevectors_3)  # -> Point, Hit; disabled
meshray_8 = MeshRay(Mesh=graft(graft_4), Point=graft(samplepoints), Direction=samplevectors_3)  # -> Point, Hit; disabled
and = GateAnd(A=meshray_6.Hit, B=meshray_7.Hit)  # disabled
and_2 = GateAnd(A=meshray_4.Hit, B=meshray_6.Hit)  # disabled
exdiff = SetDifferenceS(SetA=meshray_4.Point, SetB=meshray_6.Point)  # disabled
difference = SetDifference(SetA=meshray_6.Point, SetB=meshray_7.Point)  # disabled
cullpt = CullDuplicates(Tolerance=0.1, CullMode=3)  # -> Points, Indices, Valence; disabled
lng_10 = ListLength(List=exdiff)  # disabled
lng_11 = ListLength(List=samplevectors_3)  # disabled
division_2 = Division(A=lng_11, B=lng_10)  # disabled
srftempmesh = Mesh(flatten(debrep_8.Faces))  # disabled
panel_15 = Panel(division_2)  # disabled
toggle_10 = BooleanToggle(True)  # disabled
clean_6 = CleanTree(RemoveNulls=toggle_10, RemoveInvalid=toggle_10, RemoveEmpty=toggle_10, Tree=meshray_7.Point)  # -> simplify(Tree); disabled
toggle_11 = BooleanToggle(False)  # disabled
incurve_3 = PointInCurve(Point=graft(clean_6), Curve=join_5)  # -> Relationship, Point; disabled
minc = MeshInclusion(Mesh=srftempmesh, Point=graft(clean_6), Strict=toggle_11)  # -> simplify(graft(Inside)); disabled
path_mapper_3 = PathMapper(incurve_3.Relationship, source="{A;B}", target="{A}")  # disabled
viewer_5 = ParamViewer(path_mapper_3)  # disabled
path_mapper_4 = PathMapper(minc, source="{A;B;C}", target="{A;C}")  # disabled
panel_16 = Panel("2")  # disabled
equals_3 = Equality(FirstNumber=panel_16, SecondNumber=path_mapper_3)  # -> Equality, Inequality; disabled
ma_3 = MassAddition(Input=equals_3.Equality)  # -> Result, PartialResults; disabled
ma_4 = MassAddition(Input=path_mapper_4)  # -> Result, PartialResults; disabled
lng_12 = ListLength(List=samplevectors_3)  # disabled
panel_17 = Panel(ma_4.Result)  # disabled
item_3 = ListItem(List=path_mapper_4, Index=0, Wrap=True)  # disabled
division_3 = Division(A=ma_3.Result, B=lng_12)  # disabled
panel_18 = Panel(path_mapper_4)  # disabled
panel_19 = Panel(division_3)  # disabled

samplepoints_2 = Point(analysispoints_2)  # disabled

logicpause = GhPythonScript(x=createbat, y=createbat_2)  # -> a, b
# ---------- logicpause: Python ----------
a = 1
b = "Verdana"
# ---------- end logicpause ----------
hbzones_2 = Data(flatten(hbzones))
labelzones = Honeybee_LabelZones(HBZones=flatten(hbzones_2), attribute="name", font=logicpause.b)  # -> zoneTxtLabels, labelBasePts, brepTxtLabels, zoneWireFrames; plug-in component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
tsort = SortText(Keys=labelzones.zoneTxtLabels, Values=hbzones_2, Culture=127)  # -> Keys, Values
skypatchdensity = Panel("1")
debrep_9 = DeconstructBrep(Brep=tsort.Values)  # -> flatten(Faces), Edges, Vertices; disabled
toggle_12 = BooleanToggle(True)  # disabled
toggle_13 = BooleanToggle(True)  # disabled
lng_13 = ListLength(List=debrep_9.Faces)  # disabled
srfviewfactors = Ladybug_SurfaceViewAnalysis(
    testPtsOrPlanes=flatten(analysispoints_2),
    testSrfs=debrep_9.Faces,
    context=hbcontext_2,
    viewResolution=skypatchdensity,
    parallel=toggle_13,
    runIt=toggle_12)  # -> readMe, srfViewFactors, viewVecSrfIndex, viewVectors, viewPatches, viewPatchBasePt; disabled; plug-in component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
split_2 = SplitList(List=srfviewfactors.srfViewFactors, Index=lng_13)  # -> simplify(ListA), simplify(ListB); disabled

viewer_6 = ParamViewer(samplepoints_2)  # disabled

# ----
# Alternative method
# Still not fast enough
toggle_14 = BooleanToggle(True)
indoorviewfactor = Honeybee_IndoorViewFactorCalculator(
    HBZones=flatten(tsort.Values),
    distFromFloorOrSrf=flatten(analysispoints_2),
    additionalShading=flatten(hbcontext_2),
    includeOutdoor=toggle_14,
    viewResolution=skypatchdensity,
    parallel=Toggle(True),
    buildMesh=Toggle(True),
    runIt=Toggle(True))  # -> readMe, port, viewFactorMesh, viewFactorInfo, port_2, testPts, viewMeshFaces, zoneWireFrame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; plug-in component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
python_17 = GhPythonScript(viewFactorInfo=indoorviewfactor.viewFactorInfo)  # -> samplePtSrfView, samplePtSkyView; inputs viewFactorInfo: list
# ---------- python_17: Python ----------
from System import Object
from System import Drawing
import System
import Grasshopper.Kernel as gh
from Grasshopper import DataTree
from Grasshopper.Kernel.Data import GH_Path
import Rhino as rc
import scriptcontext as sc
import math
import os

import ghpythonlib.treehelpers as th


w = gh.GH_RuntimeMessageLevel.Warning
tol = sc.doc.ModelAbsoluteTolerance

#Check to be sure that LB+HB are flying.
initCheck = False
if sc.sticky.has_key('honeybee_release') == False and sc.sticky.has_key('ladybug_release') == False:
    print "You should first let Ladybug and Honeybee fly..."
    ghenv.Component.AddRuntimeMessage(w, "You should first let Ladybug and Honeybee fly...")
else:
    initCheck = True
    lb_preparation = sc.sticky["ladybug_Preparation"]()
    lb_wind = sc.sticky["ladybug_WindSpeed"]()
    hb_hive = sc.sticky["honeybee_Hive"]()

viewFacInfoFromHive = hb_hive.visualizeFromHoneybeeHive(_viewFactorInfo)[0]

testPtViewFactor, zoneSrfNames, testPtSkyView, testPtBlockedVec, testPtZoneWeights, \
testPtZoneNames, ptHeightWeights, zoneInletInfo, zoneHasWindows, outdoorIsThere, \
outdoorNonSrfViewFac, outdoorPtHeightWeights, testPtBlockName, zoneWindowTransmiss, \
zoneWindowNames, zoneFloorReflectivity, constantTransmis, finalAddShdTransmiss = viewFacInfoFromHive.recallAllProps()

samplePtSrfView = layerTree = th.list_to_tree(testPtViewFactor[6], source=[0,0])
samplePtSkyView = testPtSkyView[6]
# ---------- end python_17 ----------

writeskyviewfactors = GhPythonScript(outputDir=outputdirectory_2, caseName=toplayer_2, skyViewFactors=ptskyexposure)  # -> info; inputs skyViewFactors: list, write: Boolean; disabled
# ---------- writeskyviewfactors: Python ----------
import os

outpath = os.path.join(_outputDir, _caseName, "_sky_view_factors.vf")

if _write:
    with open(outpath, "w") as f:
        for svf in _skyViewFactors:
            f.write("{}\n".format(svf))
    info = "File written to {}".format(outpath)
else:
    info = "File will be written to {}".format(outpath)
# ---------- end writeskyviewfactors ----------
meshray_9 = MeshRay(Mesh=debrep_4.Faces, Point=graft(samplepoints_2), Direction=graft(samplevectors_2))  # -> Point, Hit; disabled
meshray_10 = MeshRay(Mesh=graft(mjoin_2), Point=graft(samplepoints_2), Direction=samplevectors_2)  # -> Point, Hit; disabled
meshray_11 = MeshRay(Mesh=graft(mjoin_4), Point=graft(samplepoints_2), Direction=samplevectors_2)  # -> Point, Hit; disabled
meshray_12 = MeshRay(Mesh=graft(mjoin_3), Point=graft(samplepoints_2), Direction=samplevectors_2)  # -> Point, Hit; disabled
meshray_13 = MeshRay(Mesh=graft(debrep_3.Faces), Point=graft(samplepoints_2), Direction=samplevectors_2)  # -> Point, Hit; disabled
panel_20 = Panel(writeskyviewfactors)  # disabled
surface_view_factors = Data(python_17.samplePtSrfView)

toggle_15 = BooleanToggle(True)
writesurfaceviewfactors = GhPythonScript(outputDir=outputdirectory_2, caseName=toplayer_2, surfaceViewFactors=surface_view_factors, write=toggle_15)  # -> info; inputs surfaceViewFactors: tree, write: Boolean
# ---------- writesurfaceviewfactors: Python ----------
import os

outpath = os.path.join(_outputDir, _caseName, "_surface_view_factors.vf")

if _write:
    with open(outpath, "w") as f:
        # for each branc of tree
        for i in range(_surfaceViewFactors.BranchCount):
            # Join into string and write to file
            f.write("{}\n".format(",".join([str(j) for j in _surfaceViewFactors.Branch(i)])))
    info = "File written to {}".format(outpath)
else:
    info = "File will be written to {}".format(outpath)
# ---------- end writesurfaceviewfactors ----------
writegndreflectivity = GhPythonScript(outputDir=outputdirectory_2, caseName=toplayer_2, gndReflectivities=point_ground_reflectivities, write=toggle_15)  # -> info; inputs gndReflectivities: list, write: Boolean
# ---------- writegndreflectivity: Python ----------
import os

outpath = os.path.join(_outputDir, _caseName, "_ground_reflectivities.rfl")

if _write:
    with open(outpath, "w") as f:
        for refl in _gndReflectivities:
            f.write("{}\n".format(refl))
    info = "File written to {}".format(outpath)
else:
    info = "File will be written to {}".format(outpath)
# ---------- end writegndreflectivity ----------
writeboundarypts = GhPythonScript(outputDir=outputdirectory_2, caseName=toplayer_2, boundaryPoints=analysisregionboundaryvertices, write=toggle_15)  # -> info; inputs boundaryPoints: list of Point3d, write: Boolean
# ---------- writeboundarypts: Python ----------
import os

outpath = os.path.join(_outputDir, _caseName, "_boundary_points.xyz")

if _write:
    with open(outpath, "w") as f:
        for pt in _boundaryPoints:
            f.write("{}, {}, {}\n".format(pt.X, pt.Y, pt.Z))
    info = "File written to {}".format(outpath)
else:
    info = "File will be written to {}".format(outpath)
# ---------- end writeboundarypts ----------
writesamplepts = GhPythonScript(outputDir=outputdirectory_2, caseName=toplayer_2, samplePoints=analysispoints_2, write=toggle_15)  # -> info; inputs samplePoints: list of Point3d, write: Boolean
# ---------- writesamplepts: Python ----------
import os

outpath = os.path.join(_outputDir, _caseName, "_sample_points.xyz")

if _write:
    with open(outpath, "w") as f:
        for pt in _samplePoints:
            f.write("{}, {}, {}\n".format(pt.X, pt.Y, pt.Z))
    info = "File written to {}".format(outpath)
else:
    info = "File will be written to {}".format(outpath)
# ---------- end writesamplepts ----------
panel_21 = Panel(writesurfaceviewfactors)
panel_22 = Panel(writegndreflectivity)
panel_23 = Panel(writesamplepts)
panel_24 = Panel(writeboundarypts)

# ---- group: TESTING GROUP FOR DODGY GEOMETRY!
# TEST SPACE FOR DODGY GROUND GEOMETRY
# - Enable to check model validity!
toggle_16 = BooleanToggle(True)  # disabled
panel_25 = Panel("AverageOverDaysInFrequency")  # disabled
toggle_17 = BooleanToggle(False)  # disabled
panel_26 = Panel("365")  # disabled
panel_27 = Panel("200")  # disabled
importgroundtemp_2 = Ladybug_ImportGroundTemp(epwFile=weatherfile_3)  # -> readMe, groundtemp1st, groundtemp2nd, groundtemp3rd, profileCrvs, crvColors, graphAxes, graphtext, Legend; disabled; plug-in component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
simcontrol_2 = Honeybee_SimulationControl(
    doZoneSizingCalculation=toggle_17,
    doSystemSizingCalculation=toggle_17,
    doPlantSizingCalculation=toggle_17,
    runSimForSizingPeriods=toggle_17,
    runSimForRunPeriods=toggle_16)  # -> simControls; disabled; plug-in component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
shadowpar_2 = Honeybee_ShadowPar(calculationMethod=panel_25, frequency=panel_26, maximumFigure=panel_27)  # -> shadowPar; disabled; plug-in component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
isconvex = Honeybee_FindNonConvex(breps=hbzones)  # -> readMe, nonConvex, faultyGeometry; disabled; plug-in component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
strnum_2 = Ladybug_SeparateData(inputList=flatten(importgroundtemp_2.groundtemp1st))  # -> numbers, strings; disabled; plug-in component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
panel_28 = Panel("""OutputControl:Table:Style,Comma;
Output:Variable,*,Site Outdoor Air Drybulb Temperature, hourly;
Output:Diagnostics,DisplayExtraWarnings;""")  # disabled
panel_29 = Panel("0")  # disabled
panel_30 = Panel("4")  # disabled
panel_31 = Panel("0")  # disabled
panel_32 = Panel("Output:Diagnostics,DisplayExtraWarnings;")  # disabled
panel_33 = Panel("5")  # disabled
panel_34 = Panel("19")  # disabled
panel_35 = Panel("12")  # disabled
energysimpar_2 = Honeybee_EnergySimulationPar(
    timestep=panel_30,
    shadowCalcPar=shadowpar_2,
    solarDistribution=panel_29,
    simulationControls=simcontrol_2,
    terrain=panel_31,
    monthlyGrndTemps=strnum_2.numbers)  # -> energySimPar; disabled; plug-in component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
analysisperiod = Ladybug_AnalysisPeriod(fromMonth=panel_33, fromDay=panel_35, toMonth=panel_33, toDay=panel_34)  # -> readMe, analysisPeriod; disabled; plug-in component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
toggle_18 = BooleanToggle(True)  # disabled
swatch_3 = ColourSwatch(SwatchColor=RGB(255, 0, 0))  # disabled
swatch_4 = ColourSwatch(SwatchColor=RGB(255, 0, 251))  # disabled
panel_36 = Panel("0.5")  # disabled

# ----
preview_2 = CustomPreview(
    Geometry=isconvex.faultyGeometry,
    Material={diffuse=RGB(221, 160, 221), emission=RGB(66, 48, 66), shine=0.5, specular=RGB(255, 255, 255), transparency=0})  # disabled
exporttoopenstudio_2 = Honeybee_ExportToOpenStudio(
    epwWeatherFile=weatherfile_3,
    analysisPeriod=analysisperiod.analysisPeriod,
    energySimPar=energysimpar_2,
    HBZones=flatten(hbzones),
    HBContext=flatten(hbcontext),
    simulationOutputs=flatten(panel_28),
    additionalStrings=flatten(panel_32),
    writeOSM=toggle_18,
    runSimulation=toggle_18)  # -> readMe, osmFileAddress, idfFileAddress, resultFileAddress, eioFileAddress, rddFileAddress, htmlReport, studyFolder, model; disabled; plug-in component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

# ---- group: TESTING GROUP FOR DODGY GEOMETRY! (continued)
finddodgyvertices = GhPythonScript(readme=exporttoopenstudio_2.readMe)  # -> readmeClean, dodgyPts, closePts; inputs readme: list; disabled
# ---------- finddodgyvertices: Python ----------
import re
import rhinoscriptsyntax as rs
import scriptcontext
import copy
tol = scriptcontext.doc.ModelAbsoluteTolerance

def removeDuplicates(points):
    # Create a dictionary to keep track of the Id
    pointDict = {}
    ptList = []
    for pt in points:
        pt3d = rs.coerce3dpoint(pt)
        pointDict[pt3d] = pt
        ptList.append(pt3d)
    
    #sortList
    ptList.sort()
    ptLast = ptList[-1]
    
    for i in range(len(ptList)-2,-1,-1):
        if (abs(ptList[i][0] - ptLast[0]) < tol) and (abs(ptList[i][1] - ptLast[1])) < tol and (abs(ptList[i][2] - ptLast[2]) < tol):
            del ptList[i]
        else:
            ptLast = ptList[i]
    
    #find the the ids with the new list
    outputList = []
    for pt in ptList:
        ptId = pointDict[pt]
        outputList.append(ptId)
    
    return outputList

duplicate_points = []
dodgy_points = []
readmeClean = []
for i in _readme:
    if len(i) != 0:
        readmeClean.append(i)
        xx = re.search('(?<=\{)(.*)(?=\})', i, re.IGNORECASE)
        if xx is not None:
            xx = (map( float, xx.group(1).split(',')))
            dodgy_points.append(rs.AddPoint(xx))
        xx = re.search('(?<==\()(.*)(?=\))', i, re.IGNORECASE)
        if xx is not None:
            xx = (map( float, xx.group(1).split(',')))
            duplicate_points.append(rs.AddPoint(xx))

closePts = duplicate_points if len(duplicate_points) == 0 else removeDuplicates(duplicate_points)
dodgyPts = dodgy_points if len(dodgy_points) == 0 else removeDuplicates(dodgy_points)
# ---------- end finddodgyvertices ----------
entwine = Entwine(Branch00=finddodgyvertices.dodgyPts, Branch01=finddodgyvertices.closePts, FlattenInputs=True)  # -> simplify(Result); disabled
dots_2 = DotDisplay(Point=entwine, Colour=graft([swatch_3, swatch_4]), Size=panel_36)  # disabled
panel_37 = Panel(finddodgyvertices.readmeClean)  # disabled

# ----
panel_38 = Panel(exporttoopenstudio_2.idfFileAddress)  # disabled

# ==== cluster Cluster
layername = ClusterInput()
toplayer = ClusterInput()
layername_2 = Data(layername)
toplayer_2 = Data(toplayer)
concat = Concatenate(FragmentA=toplayer_2, FragmentC="::", FragmentB=layername_2)
list = ValueList({"All objects": 0, "Point": 1, "Point cloud": 2, "Curve": 4, "Surface or single-face brep": 8, "Polysurface or multiple-face": 16, "Mesh": 32, "Light": 256, "Annotation": 512, "Instance or block reference": 4096, "Text dot object": 8192, "Grip object": 16384, "Detail": 32768, "Hatch": 65536, "Morph control": 131072, "Cage": 134217728, "Phantom": 268435456, "Clipping plane": 536870912, "Extrusion": 1073741824}, selected="Polysurface or multiple-face")
list_2 = ValueList({"All objects": 0, "Point": 1, "Point cloud": 2, "Curve": 4, "Surface or single-face brep": 8, "Polysurface or multiple-face": 16, "Mesh": 32, "Light": 256, "Annotation": 512, "Instance or block reference": 4096, "Text dot object": 8192, "Grip object": 16384, "Detail": 32768, "Hatch": 65536, "Morph control": 131072, "Cage": 134217728, "Phantom": 268435456, "Clipping plane": 536870912, "Extrusion": 1073741824}, selected="Surface or single-face brep")
toggle = BooleanToggle(True)
refobjects = PythonScript(layer=concat, geometryType=list, run=toggle)  # -> objects; inputs geometryType: Int32, run: Boolean
# ---------- refobjects: Python ----------
import rhinoscriptsyntax as rs
import scriptcontext as sc
import Rhino
from Grasshopper.Kernel import GH_RuntimeMessageLevel as RML

if _run:
    sc.doc = Rhino.RhinoDoc.ActiveDoc
    try:
        # Reference objects
        objects = rs.ObjectsByLayer(_layer)
        # Filter by type
        objects = [obj for obj in rs.ObjectsByLayer(_layer) if rs.ObjectType(obj)==_geometryType]
    except:
        ghenv.Component.AddRuntimeMessage(RML.Error, "The layer {0:} does not exist in LayerTable.".format( _layer))
    sc.doc = ghdoc
# ---------- end refobjects ----------
refobjects_2 = PythonScript(layer=concat, geometryType=list_2, run=toggle)  # -> objects; inputs geometryType: Int32, run: Boolean; same code as refobjects
merge = Merge(Data1=refobjects, Data2=refobjects_2)  # -> flatten(Result)
debrep = DeconstructBrep(Brep=merge)  # -> flatten(Faces), Edges, Vertices
namify = GhPythonScript(geometry=debrep.Faces, name=layername_2)  # -> names; inputs geometry: list
# ---------- namify: Python ----------
names = []

for n in range(len(_geometry)):
    names.append("{0:}{1:}".format(_name, n))
# ---------- end namify ----------
surfacenames = Data(namify)
surfaces = Surface(debrep.Faces)
surfacenames_2 = ClusterOutput(surfacenames)
surfaces_2 = ClusterOutput(surfaces)

# ==== cluster Cluster_2
surfaces = ClusterInput()
surfaces_2 = Surface(surfaces)
project = Project(Geometry=surfaces_2, Plane=PlaneXY(0, 0, 0))  # -> Geometry, Transform
area = Area(Geometry=project.Geometry)  # -> Area, Centroid
smaller = SmallerThan(FirstNumber=area.Area, SecondNumber="0.0001")  # -> SmallerThan, OrEqualTo
dispatch = Dispatch(List=surfaces_2, DispatchPattern=smaller.SmallerThan)  # -> ListA, ListB
edges = BrepEdges(Brep=dispatch.ListB)  # -> Naked, Interior, NonManifold
join = JoinCurves(Curves=edges.Naked, Preserve=False)
explode = Explode(Curve=join, Recursive=True)  # -> Segments, simplify(Vertices)
shift = ShiftList(List=explode.Vertices, Shift=1, Wrap=False)
short = ShortestList(ListA=explode.Vertices, ListB=shift, TrimMode=2)  # -> ListA, ListB
item = ListItem(List=short.ListA, Index=0, Wrap=True)  # -> Item, Item1
item_2 = ListItem(List=short.ListB, Index=0, Wrap=True)  # -> Item, Item1
vec2pt = Vector2Pt(PointA=item.Item, PointB=item_2.Item, Unitize=False)  # -> Vector, Length
vec2pt_2 = Vector2Pt(PointA=item.Item1, PointB=item_2.Item1, Unitize=False)  # -> Vector, Length
Z = UnitZ(Factor=1)
xprod = CrossProduct(VectorA=vec2pt.Vector, VectorB=vec2pt_2.Vector, Unitize=False)  # -> Vector, Length
cset = CreateSet(List=explode.Vertices)  # -> Set, Map
dprod = DotProduct(VectorA=xprod.Vector, VectorB=Z, Unitize=True)
larger = LargerThan(FirstNumber=dprod, SecondNumber=0)  # -> LargerThan, OrEqualTo
rev = ReverseList(List=cset.Set)
cull = CullPattern(List=rev, CullPattern=invert(larger.LargerThan))
cull_2 = CullPattern(List=cset.Set, CullPattern=larger.LargerThan)
merge = Merge(Data1=cull_2, Data2=cull)
pline = PolyLine(Vertices=merge, Closed=Toggle(True))
boundaries = Data(flatten(pline))
boundaries_2 = ClusterOutput(boundaries)

# ==== cluster Cluster_3
solarabsorptivity = ClusterInput()
solarabsorptivity_2 = Data(solarabsorptivity)
subtraction = Subtraction(A="1", B=solarabsorptivity_2)
reflectivity = Data(subtraction)
reflectivity_2 = ClusterOutput(reflectivity)

# ==== cluster Cluster_4
geometrytype = ClusterInput()
refresh = ClusterInput()
layer = ClusterInput()
case = ClusterInput()
geometrytype_2 = Integer(geometrytype)
refresh_2 = Boolean(refresh)
layer_2 = Text(layer)
case_2 = Text(case)
concat = Concatenate(FragmentA=case_2, FragmentC="::", FragmentB=layer_2)
refobjects = PythonScript(layer=concat, geometryType=geometrytype_2, run=refresh_2)  # -> objects; inputs geometryType: Int32, run: Boolean; same code as refobjects
toggle = BooleanToggle(True)
clean = CleanTree(RemoveNulls=toggle, RemoveInvalid=toggle, RemoveEmpty=toggle, Tree=refobjects)
geometry = Geometry(clean)
geometry_2 = ClusterOutput(geometry)
