# Grasshopper definition sandbox.gh (Grasshopper 1.0.7)

loadgeometry = BooleanToggle(True)

list = ValueList({"All objects": 0, "Point": 1, "Point cloud": 2, "Curve": 4, "Surface or single-face brep": 8, "Polysurface or multiple-face": 16, "Mesh": 32, "Light": 256, "Annotation": 512, "Instance or block reference": 4096, "Text dot object": 8192, "Grip object": 16384, "Detail": 32768, "Hatch": 65536, "Morph control": 131072, "Cage": 134217728, "Phantom": 268435456, "Clipping plane": 536870912, "Extrusion": 1073741824}, selected="Polysurface or multiple-face")
join = TextJoin(Text=["CASE", "BDG_CONTEXT"], Join="::")
refobjects = PythonScript(layer=join, geometryType=list, run=loadgeometry)  # -> objects; inputs geometryType: Int32, run: Boolean
# ---------- refobjects: Python ----------
import rhinoscriptsyntax as rs
import scriptcontext as sc
import Rhino
from Grasshopper.Kernel import GH_RuntimeMessageLevel as RML

if _run:
    sc.doc = Rhino.RhinoDoc.ActiveDoc
    try:
        # Reference objects
        objects = rs.ObjectsByLayer(_layer)
        # Filter by type and state
        objects = [obj for obj in rs.ObjectsByLayer(_layer) if rs.ObjectType(obj)==_geometryType]
        # Filter by state
        
    except:
        ghenv.Component.AddRuntimeMessage(RML.Error, "The layer {0:} does not exist in LayerTable.".format( _layer))
    sc.doc = ghdoc
# ---------- end refobjects ----------

list_2 = ValueList({"All objects": 0, "Point": 1, "Point cloud": 2, "Curve": 4, "Surface or single-face brep": 8, "Polysurface or multiple-face": 16, "Mesh": 32, "Light": 256, "Annotation": 512, "Instance or block reference": 4096, "Text dot object": 8192, "Grip object": 16384, "Detail": 32768, "Hatch": 65536, "Morph control": 131072, "Cage": 134217728, "Phantom": 268435456, "Clipping plane": 536870912, "Extrusion": 1073741824}, selected="Surface or single-face brep")
join_2 = TextJoin(Text=["CASE", "GND_SURROUNDING"], Join="::")
refobjects_2 = PythonScript(layer=join_2, geometryType=list_2, run=loadgeometry)  # -> objects; inputs geometryType: Int32, run: Boolean; same code as refobjects

list_3 = ValueList({"All objects": 0, "Point": 1, "Point cloud": 2, "Curve": 4, "Surface or single-face brep": 8, "Polysurface or multiple-face": 16, "Mesh": 32, "Light": 256, "Annotation": 512, "Instance or block reference": 4096, "Text dot object": 8192, "Grip object": 16384, "Detail": 32768, "Hatch": 65536, "Morph control": 131072, "Cage": 134217728, "Phantom": 268435456, "Clipping plane": 536870912, "Extrusion": 1073741824}, selected="Surface or single-face brep")
join_3 = TextJoin(Text=["CASE", "GND_CONCRETE"], Join="::")
refobjects_3 = PythonScript(layer=join_3, geometryType=list_3, run=loadgeometry)  # -> objects; inputs geometryType: Int32, run: Boolean; same code as refobjects

list_4 = ValueList({"All objects": 0, "Point": 1, "Point cloud": 2, "Curve": 4, "Surface or single-face brep": 8, "Polysurface or multiple-face": 16, "Mesh": 32, "Light": 256, "Annotation": 512, "Instance or block reference": 4096, "Text dot object": 8192, "Grip object": 16384, "Detail": 32768, "Hatch": 65536, "Morph control": 131072, "Cage": 134217728, "Phantom": 268435456, "Clipping plane": 536870912, "Extrusion": 1073741824}, selected="Surface or single-face brep")
join_4 = TextJoin(Text=["CASE", "ANALYSIS_PLANE"], Join="::")
refobjects_4 = PythonScript(layer=join_4, geometryType=list_4, run=loadgeometry)  # -> objects; inputs geometryType: Int32, run: Boolean; same code as refobjects

list_5 = ValueList({"All objects": 0, "Point": 1, "Point cloud": 2, "Curve": 4, "Surface or single-face brep": 8, "Polysurface or multiple-face": 16, "Mesh": 32, "Light": 256, "Annotation": 512, "Instance or block reference": 4096, "Text dot object": 8192, "Grip object": 16384, "Detail": 32768, "Hatch": 65536, "Morph control": 131072, "Cage": 134217728, "Phantom": 268435456, "Clipping plane": 536870912, "Extrusion": 1073741824}, selected="Surface or single-face brep")
join_5 = TextJoin(Text=["CASE", "SHD_SOLID"], Join="::")
refobjects_5 = PythonScript(layer=join_5, geometryType=list_5, run=loadgeometry)  # -> objects; inputs geometryType: Int32, run: Boolean; same code as refobjects

# ---- group: Create sample points
genmesh = Ladybug_GenerateMesh(testGeometry=refobjects_4, gridSize="15", distBaseSrf="1.2", moveTestMesh=True)  # -> readMe, simplify(testPoints), simplify(ptsVectors), simplify(facesArea), simplify(mesh); plug-in component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
samplepoints = Point(genmesh.testPoints)

# ---- group: All geometry as ray-blockers
skyexposureblockers = Data([refobjects, refobjects_2, refobjects_3, refobjects_5])
debrep = DeconstructBrep(Brep=skyexposureblockers)  # -> Faces, Edges, Vertices
skyviewfactorcontext = Surface(flatten(debrep.Faces))

# ---- group: Create sample vectors
n_samples = Panel("10000")
fibonaccisphere_py = GhPythonScript(nPoints=n_samples, scale="1000")  # -> points; inputs nPoints: Int32, anchor: Point3d
# ---------- fibonaccisphere_py: Python ----------
__author__ = "tgerrish"
__version__ = "2020.05.22"

import rhinoscriptsyntax as rs
import math

# Translation to anchor point
if anchor is None:
    anchor = rs.CreatePoint(0, 0, 0)
basePt = rs.CreatePoint(0, 0, 0)
translationVector = anchor - basePt
print(translationVector)

indices = [i + 0.5 for i in range(0, nPoints)]
phi = [math.acos(1 - 2 * i / nPoints) for i in indices]
theta = [math.pi * (1 + 5 ** 0.5) * i for i in indices]
x = [translationVector.X + ((math.cos(theta[n]) * math.sin(phi[n])) * scale) for n in range(nPoints)]
y = [translationVector.Y + ((math.sin(theta[n]) * math.sin(phi[n])) * scale) for n in range(nPoints)]
z = [translationVector.Z + ((math.cos(phi[n])) * scale) for n in range(nPoints)]

points = []
for i, j, k in list(zip(*[x, y, z])):
    points.append(rs.AddPoint([i, j, k]))

#if abs(translationVector.X) + abs(translationVector.Y) + abs(translationVector.Z) != 0:
# ---------- end fibonaccisphere_py ----------
samplevectors = Vector(fibonaccisphere_py)

# ----
ladybug = Ladybug_Ladybug()  # -> Vviiiiiiiiiizzz; plug-in component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
bang = ExplodeTree(Data=graft(refobjects))  # -> Branch0, Branch1, Branch2, Branch3
data = Data([bang.Branch0, bang.Branch3])
calculatedsrftempobjects = Brep(data)
indoorviewfactor = Honeybee_IndoorViewFactorCalculator()  # -> readMe, port, viewFactorMesh, viewFactorInfo, port_2, testPts, viewMeshFaces, zoneWireFrame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; plug-in component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
srfviewfactors = Ladybug_SurfaceViewAnalysis(viewResolution="0", parallel=Toggle(True), runIt=Toggle(True))  # -> readMe, srfViewFactors, viewVecSrfIndex, viewVectors, viewPatches, viewPatchBasePt; plug-in component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
join_6 = BrepJoin(Breps=calculatedsrftempobjects)  # -> Breps, Closed
debrep_2 = DeconstructBrep(Brep=join_6.Breps)  # -> flatten(Faces), Edges, Vertices
panel = Panel(srfviewfactors.srfViewFactors)
edges = BrepEdges(Brep=debrep_2.Faces)  # -> Naked, Interior, NonManifold
mesh = Mesh(flatten(debrep_2.Faces))
join_7 = JoinCurves(Curves=edges.Naked, Preserve=False)  # -> flatten(Curves)
ma = MassAddition(Input=srfviewfactors.srfViewFactors)  # -> Result, PartialResults
mjoin = MeshJoin(Meshes=mesh)
line = LineSDL(Direction=srfviewfactors.viewVectors, Length="20")
meshray = MeshRay(Mesh=graft(mjoin), Point=graft(samplepoints), Direction=samplevectors)  # -> Point, Hit
meshray_2 = MeshRay(Mesh=graft(mesh), Point=graft(samplepoints), Direction=samplevectors)  # -> Point, Hit

# ---- group: Split sample vectors into Ground/Sky facing
pdecon = Deconstruct(Point=samplevectors)  # -> XComponent, YComponent, ZComponent
smaller = SmallerThan(FirstNumber=pdecon.ZComponent, SecondNumber="0")  # -> SmallerThan, OrEqualTo
dispatch = Dispatch(List=samplevectors, DispatchPattern=smaller.SmallerThan)  # -> ListA, ListB
groundwardvectors = Vector(dispatch.ListA)
skywardvectors = Vector(dispatch.ListB)

# ----
meshray_3 = MeshRay(Mesh=graft(mjoin), Point=graft(samplepoints), Direction=samplevectors)  # -> Point, Hit
toggle = BooleanToggle(True)
clean = CleanTree(RemoveNulls=toggle, RemoveInvalid=toggle, RemoveEmpty=toggle, Tree=meshray_3.Point)  # -> simplify(Tree)
fsim = FindSimilarMember(Data=clean, Set=meshray.Point)  # -> Hit, Index

# ---- group: Count sample vectors reaching sky from sample points
mjoin_2 = MeshJoin(Meshes=flatten(skyviewfactorcontext))
meshray_4 = MeshRay(Mesh=mjoin_2, Point=graft(samplepoints), Direction=skywardvectors)  # -> Point, Hit
lng = ListLength(List=skywardvectors)
ma_2 = MassAddition(Input=meshray_4.Hit)  # -> Result, PartialResults
division = Division(A=ma_2.Result, B=lng)  # -> flatten(Result)
subtraction = Subtraction(A="1", B=division)

# ----
incurve = PointInCurve(Point=graft(clean), Curve=join_7)  # -> Relationship, Point
minc = MeshInclusion(Mesh=mesh, Point=graft(clean), Strict=Toggle(False))  # -> simplify(graft(Inside))
path_mapper = PathMapper(incurve.Relationship, source="{A;B}", target="{A}")

# ---- group: Ladybug-Legacy method
shadingmask = Ladybug_ShadingMask(centerPtOrPlane=samplepoints, context=skyviewfactorcontext, skyDensity="3", projection="1")  # -> contextMask, orientationMask, strategyMask, skyMask, port, contextExposure, orientExposure, strategyExposure, skyExposure; plug-in component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

# ----
viewer = ParamViewer(path_mapper)
path_mapper_2 = PathMapper(minc, source="{A;B;C}", target="{A;C}")
equals = Equality(FirstNumber="2", SecondNumber=path_mapper)  # -> Equality, Inequality
ma_3 = MassAddition(Input=equals.Equality)  # -> Result, PartialResults
ma_4 = MassAddition(Input=path_mapper_2)  # -> Result, PartialResults
lng_2 = ListLength(List=samplevectors)
panel_2 = Panel(ma_4.Result)

# ----
# Calculate sky exposure for
# each sample point
skyviewfactor_tg = Panel(subtraction)
skyviewfactor_lb = Panel(shadingmask.skyExposure)

item = ListItem(List=path_mapper_2, Index=0, Wrap=True)
division_2 = Division(A=ma_3.Result, B=lng_2)
panel_3 = Panel(path_mapper_2)
panel_4 = Panel(division_2)
